# Dynamo graph mergePipingSystem_script.dyn (Dynamo 2.10.1.3976)

# group: pick first Pipe Part, second Pipe Part
boolean = BoolSelector(false)
pickFirst = Python(IN[0]=boolean)  # IronPython2
# ---------- pickFirst.python (79 lines) ----------
"""Copyright by: vudinhduybm@gmail.com"""
#region ___import all Library
import clr
import sys 
import System   
import math
import collections


clr.AddReference("ProtoGeometry")

from Autodesk.DesignScript.Geometry import *

clr.AddReference("RevitAPI") 
import Autodesk
from Autodesk.Revit.DB import* 
from Autodesk.Revit.DB.Structure import*

clr.AddReference("RevitAPIUI") 
from Autodesk.Revit.UI import*
from Autodesk.Revit.UI.Selection import ISelectionFilter
clr.AddReference("System") 
from System.Collections.Generic import List

clr.AddReference("RevitNodes")
import Revit
clr.ImportExtensions(Revit.Elements)
clr.ImportExtensions(Revit.GeometryConversion)

clr.AddReference("RevitServices")
import RevitServices
from RevitServices.Persistence import DocumentManager
from RevitServices.Transactions import TransactionManager
from Autodesk.Revit.UI.Selection import ObjectType
clr.AddReference("System.Windows.Forms")
clr.AddReference("System.Drawing")
clr.AddReference("System.Windows.Forms.DataVisualization")

import System.Windows.Forms 
from System.Windows.Forms import *
import System.Drawing
from System.Drawing import *
#endregion

#region ___Current doc/app/ui
doc = DocumentManager.Instance.CurrentDBDocument
uiapp = DocumentManager.Instance.CurrentUIApplication
app = uiapp.Application
uidoc = DocumentManager.Instance.CurrentUIApplication.ActiveUIDocument
view = doc.ActiveView
#endregion

#region ___someFunctions
def uwList(input):
    result = input if isinstance(input, list) else [input]
    return UnwrapElement(input)
class SelectionFilter(ISelectionFilter):
    def __init__(self, categories):
        self.categories = categories
    def AllowElement(self, element):
        return element.Category.Name in self.categories
def pickPipePart():
    categories = ["Pipe Fittings", "Pipe Accessories", "Pipes"]
    fittingFilter = SelectionFilter(categories)
    ref = uidoc.Selection.PickObject(Autodesk.Revit.UI.Selection.ObjectType.Element, fittingFilter, "Pick a fitting or accessory or pipes")
    element = doc.GetElement(ref.ElementId)
    return element	
#endregion


eleList   = uwList(IN[0])

# Do some action in a Transaction
TransactionManager.Instance.EnsureInTransaction(doc)


TransactionManager.Instance.TransactionTaskDone()

OUT = pickPipePart()
# ----------------------------------------
code_block = CodeBlock(data=boolean, waitfor=pickFirst) { [data, waitfor]; }
pickSecond = Python(IN[0]=code_block)  # IronPython2; same code as pickFirst

# group: Merge Piping System
connect_pipePart1To_pipePart2 = Python(IN[0]=pickFirst, IN[1]=pickSecond)  # IronPython2
# ---------- connect_pipePart1To_pipePart2.python (101 lines) ----------
"""Copyright by: vudinhduybm@gmail.com"""
#region ___import all Library
import clr
import sys 
import System   
import math
import collections

clr.AddReference("ProtoGeometry")
from math import *
from Autodesk.DesignScript.Geometry import *

clr.AddReference("RevitAPI") 
import Autodesk
from Autodesk.Revit.DB import* 
from Autodesk.Revit.DB.Structure import*

clr.AddReference("RevitAPIUI") 
from Autodesk.Revit.UI import*

clr.AddReference("System") 
from System.Collections.Generic import List

clr.AddReference("RevitNodes")
import Revit
clr.ImportExtensions(Revit.Elements)
clr.ImportExtensions(Revit.GeometryConversion)

clr.AddReference("RevitServices")
import RevitServices
from RevitServices.Persistence import DocumentManager
from RevitServices.Transactions import TransactionManager

clr.AddReference("System.Windows.Forms")
clr.AddReference("System.Drawing")
clr.AddReference("System.Windows.Forms.DataVisualization")

import System.Windows.Forms 
from System.Windows.Forms import *
import System.Drawing
from System.Drawing import *
#endregion

#region ___Current doc/app/ui
doc = DocumentManager.Instance.CurrentDBDocument
uiapp = DocumentManager.Instance.CurrentUIApplication
app = uiapp.Application
uidoc = DocumentManager.Instance.CurrentUIApplication.ActiveUIDocument
view = doc.ActiveView
#endregion

#region ___someFunctions
def uwList(input):
    result = input if isinstance(input, list) else [input]
    return UnwrapElement(input)
    originConns = flatten(tmp2)
def findNearestConnector(connectorSet, targetPoint):
    nearest_connector = None
    minDistance = float('inf')
    
    for connector in connectorSet:
        distance = (connector.Origin - targetPoint).GetLength()
        if distance < minDistance:
            minDistance = distance
            nearestConnector = connector
    
    return nearestConnector
def connect2Connectors(doc, pipePart1, pipePart2):
    TransactionManager.Instance.EnsureInTransaction(doc)
    if pipePart1.Category.Name != 'Pipes':
        pipePart1Connectors = [conn for conn in pipePart1.MEPModel.ConnectorManager.Connectors]   
    if pipePart1.Category.Name == 'Pipes':
        pipePart1Connectors = [conn for conn in pipePart1.ConnectorManager.Connectors]     
    if pipePart2.Category.Name != 'Pipes':
        pipePart2Connectors = [conn for conn in pipePart2.MEPModel.ConnectorManager.Connectors]   
    if pipePart2.Category.Name == 'Pipes':
        pipePart2Connectors = [conn for conn in pipePart2.ConnectorManager.Connectors] 
    nearestPipePart1Conn = findNearestConnector(pipePart1Connectors, pipePart2Connectors[0].Origin)
    nearestPipePart2Conn = findNearestConnector(pipePart2Connectors, pipePart1Connectors[0].Origin)    
    nearestPipePart1Conn.ConnectTo(nearestPipePart2Conn)
    TransactionManager.Instance.TransactionTaskDone()
    return nearestPipePart1Conn, nearestPipePart2Conn
def flatten(nestedList):
    flatList = []
    for item in nestedList:
        if isinstance(item, list):
            flatList.extend(flatten(item))
        else:
            flatList.append(item)
    return flatList
#endregion
pipePart1   = UnwrapElement(IN[0])
pipePart2	 = UnwrapElement(IN[1])

# Do some action in a Transaction
TransactionManager.Instance.EnsureInTransaction(doc)
if pipePart1 and pipePart2:
	pipePart1Conn, pipePart2Conn = connect2Connectors(doc, pipePart1, pipePart2)
TransactionManager.Instance.TransactionTaskDone()

OUT = (pipePart1Conn, pipePart2Conn)
# ----------------------------------------
