# Dynamo graph Scale Pipe_script.dyn "scalePipe_script" (Dynamo 2.10.1.3976)

boolean = BoolSelector(true)
userInputScaleLength = Python(IN[0]=boolean)  # IronPython2
# ---------- userInputScaleLength.python (78 lines) ----------
import clr
import System
clr.AddReference('System.Windows.Forms')
clr.AddReference('System.Drawing')
from System.Windows.Forms import Form, Label, TextBox, Button, DialogResult
from System.Drawing import Point, Size, Font, FontStyle, GraphicsUnit, Color

# Create a form
class MyForm(Form):
    def __init__(self):
        self.Text = 'inputAngle'
        self.Size = Size(300, 180)
        
        # Set the font and text color for the controls inside the form
        self.Font = Font("Meiryo UI", 7.5, FontStyle.Bold, GraphicsUnit.Point, 128)
        self.ForeColor = Color.Red

        # Create and add label
        self.label = Label()
        self.label.Text = "Sc_Length"
        self.label.Size = Size(260, 20)
        self.label.Location = Point(10, 10)
        self.Controls.Add(self.label)

        # Create and add text box
        self.textBox = TextBox()
        self.textBox.Location = Point(10, 40)
        self.textBox.Size = Size(260, 20)
        self.Controls.Add(self.textBox)
        self.textBox.Text = '1000'

        # Create and add OK button
        self.okButton = Button()
        self.okButton.Text = 'OK'
        self.okButton.Location = Point(110, 70)
        self.okButton.Click += self.okButton_Click
        self.Controls.Add(self.okButton)

        # Create and add Cancel button
        self.cancelButton = Button()
        self.cancelButton.Text = 'Cancel'
        self.cancelButton.Location = Point(200, 70)
        self.cancelButton.Click += self.cancelButton_Click
        self.Controls.Add(self.cancelButton)

        # Create and add @FVC label at the bottom left
        self.fvcLabel = Label()
        self.fvcLabel.Text = "@FVC"
        self.fvcLabel.Size = Size(50, 20)
        self.fvcLabel.Location = Point(10, 110)  # Bottom left corner
        self.Controls.Add(self.fvcLabel)

        self.FormBorderStyle = System.Windows.Forms.FormBorderStyle.Fixed3D
        self.result = None

    def okButton_Click(self, sender, event):
        self.result = self.textBox.Text
        self.DialogResult = DialogResult.OK
        self.Close()

    def cancelButton_Click(self, sender, event):
        self.DialogResult = DialogResult.Cancel
        self.Close()

# Show the form and get the result
form = MyForm()
result = form.ShowDialog()

# Output the result if OK was clicked
if result == DialogResult.OK:
    text_input = form.result
else:
    text_input = None

scaleLength = float(text_input)

# Assign the result to Dynamo output
OUT = scaleLength
# ----------------------------------------
scale_pipe = Python(IN[0]=userInputScaleLength)  # IronPython2
# ---------- scale_pipe.python (134 lines) ----------
"""Copyright by: vudinhduybm@gmail.com"""
#region ___import all Library
import clr
import sys 
import System   
import math
import collections

from math import cos,sin,tan,radians

clr.AddReference("ProtoGeometry")
from Autodesk.DesignScript.Geometry import *

clr.AddReference("RevitAPI") 
import Autodesk
from Autodesk.Revit.DB import* 
from Autodesk.Revit.DB.Structure import*

clr.AddReference("RevitAPIUI") 
from Autodesk.Revit.UI import*
from Autodesk.Revit.UI.Selection import ISelectionFilter
clr.AddReference("System") 
from System.Collections.Generic import List

clr.AddReference("RevitNodes")
import Revit
clr.ImportExtensions(Revit.Elements)
clr.ImportExtensions(Revit.GeometryConversion)

clr.AddReference("RevitServices")
import RevitServices
from RevitServices.Persistence import DocumentManager
from RevitServices.Transactions import TransactionManager

clr.AddReference("System.Windows.Forms")
clr.AddReference("System.Drawing")
clr.AddReference("System.Windows.Forms.DataVisualization")

import System.Windows.Forms 
from System.Windows.Forms import *
import System.Drawing
from System.Drawing import *
#endregion

#region ___Current doc/app/ui
doc = DocumentManager.Instance.CurrentDBDocument
uiapp = DocumentManager.Instance.CurrentUIApplication
app = uiapp.Application
uidoc = DocumentManager.Instance.CurrentUIApplication.ActiveUIDocument
view = doc.ActiveView
#endregion

#region ___someFunctions
def uwList(input):
    result = input if isinstance(input, list) else [input]
    return UnwrapElement(input)
def flatten(nestedList):
    flatList = []
    for item in nestedList:
        if isinstance(item, list):
            flatList.extend(flatten(item))
        else:
            flatList.append(item)
    return flatList
class PipeSelectionFilter(ISelectionFilter):
    def AllowElement(self, element):
        category = element.Category
        if category is None:
            return False
        return category.Name in ["Pipes", "Pipe Fittings", "Pipe Accessories"]
    
    def AllowReference(self, reference, position):
        return False

# Pick the element
def pickElement():
    pipeFilter = PipeSelectionFilter()
    ref = uidoc.Selection.PickObject(Autodesk.Revit.UI.Selection.ObjectType.Element, pipeFilter, "Pick a pipe, fitting, or accessory")
    element = doc.GetElement(ref.ElementId)
    return element
def sortConns_byConnected(element):
    connectors = []
    connectedConn = []
    unConnectedConn = []
    sortedConns = []
    if element.Category.Name == "Pipes":
        connectors = [conn for conn in element.ConnectorManager.Connectors]
    else:
        connectors = [conn for conn in element.MEPModel.ConnectorManager.Connectors]
    for c in connectors:
    	if c.IsConnected:
    		connectedConn.append(c)
    	else:
    		unConnectedConn.append(c)
    if len(connectedConn) == 1:
    	sortedConns.append(connectedConn)
    	sortedConns.append(unConnectedConn)
    if len(connectedConn) == 2:
    	sortedConns.append(connectedConn)
    if len(connectedConn) == 0:
    	sortedConns.append(unConnectedConn)
    return flatten(sortedConns)
def offsetPointAlongVector(point, vector, offsetDistance):
    direction = vector.Normalize()
    scaledVector = direction.Multiply(offsetDistance)
    offsetPoint = point.Add(scaledVector)
    return offsetPoint


#endregion


scaleLength = UnwrapElement(IN[0])

# Do some action in a Transaction
TransactionManager.Instance.EnsureInTransaction(doc)
pipe = pickElement()
sortedConns = sortConns_byConnected(pipe)
sortedConnsOrigin = list(c.Origin for c in sortedConns)
vector = (sortedConnsOrigin[1] - sortedConnsOrigin[0]).Normalize()
scaleVector = vector.Multiply(scaleLength/304.8)
offsetPoint = sortedConnsOrigin[1].Add(scaleVector)
newCurve = Line.CreateBound(sortedConnsOrigin[0], offsetPoint)
pipe.Location.Curve = newCurve
pipeType = pipe.PipeType
level = doc.GetElement(pipe.LevelId)

TransactionManager.Instance.EnsureInTransaction(doc)
newPipe = pipe.Create(doc, pipeType.Id, pipe.MEPSystem.GetTypeId(), level.Id, offsetPoint, sortedConnsOrigin[1])
newPipe.get_Parameter(BuiltInParameter.RBS_PIPE_DIAMETER_PARAM).Set(pipe.get_Parameter(BuiltInParameter.RBS_PIPE_DIAMETER_PARAM).AsDouble())
doc.Delete(pipe.Id)
TransactionManager.Instance.TransactionTaskDone()

OUT = newPipe
# ----------------------------------------
