# Dynamo graph connect 2 Par Pipe_script.dyn (Dynamo 2.10.1.3976)

boolean = BoolSelector(false)

# group: pick pipe
pickMainPipe = Python(IN[0]=boolean)  # IronPython2
# ---------- pickMainPipe.python (75 lines) ----------
"""Copyright by: vudinhduybm@gmail.com"""
#region ___import all Library
import clr
import sys 
import System   
import math
import collections


clr.AddReference("ProtoGeometry")

from Autodesk.DesignScript.Geometry import *

clr.AddReference("RevitAPI") 
import Autodesk
from Autodesk.Revit.DB import* 
from Autodesk.Revit.DB.Structure import*

clr.AddReference('DSCoreNodes')
from DSCore.List import Flatten

clr.AddReference("RevitAPIUI") 
from Autodesk.Revit.UI import*

clr.AddReference("System") 
from System.Collections.Generic import List

clr.AddReference("RevitNodes")
import Revit
clr.ImportExtensions(Revit.Elements)
clr.ImportExtensions(Revit.GeometryConversion)

clr.AddReference("RevitServices")
import RevitServices
from RevitServices.Persistence import DocumentManager
from RevitServices.Transactions import TransactionManager
from Autodesk.Revit.UI.Selection import ObjectType
clr.AddReference("System.Windows.Forms")
clr.AddReference("System.Drawing")
clr.AddReference("System.Windows.Forms.DataVisualization")

import System.Windows.Forms 
from System.Windows.Forms import *
import System.Drawing
from System.Drawing import *
#endregion

#region ___Current doc/app/ui
doc = DocumentManager.Instance.CurrentDBDocument
uiapp = DocumentManager.Instance.CurrentUIApplication
app = uiapp.Application
uidoc = DocumentManager.Instance.CurrentUIApplication.ActiveUIDocument
view = doc.ActiveView
#endregion

#region ___someFunctions
def uwList(input):
    result = input if isinstance(input, list) else [input]
    return UnwrapElement(input)
def PickObjects():
    ref = uidoc.Selection.PickObject(ObjectType.Element)
    eles =  doc.GetElement(ref.ElementId)
    return  eles
#endregion


eleList   = uwList(IN[0])

# Do some action in a Transaction
TransactionManager.Instance.EnsureInTransaction(doc)


TransactionManager.Instance.TransactionTaskDone()

OUT = PickObjects()
# ----------------------------------------
code_block = CodeBlock(data=boolean, waitfor=pickMainPipe) { [data, waitfor]; }
pickBranchPipe = Python(IN[0]=code_block)  # IronPython2; same code as pickMainPipe

# group: sort connector of 2 pipe
sortNearFarConnOfBranchPipe = Python(IN[0]=pickMainPipe, IN[1]=pickBranchPipe)  # IronPython2
# ---------- sortNearFarConnOfBranchPipe.python (115 lines) ----------
"""Copyright by: vudinhduybm@gmail.com"""
#region ___import all Library
import clr
import sys 
import System   
import math
import collections

sys.path.append('C:\Program Files\Autodesk\Revit 2022\AddIns\DynamoForRevit\IronPython.StdLib.2.7.9\duynamoLibrary')
from duynamoLibrary import *
clr.AddReference("ProtoGeometry")

from Autodesk.DesignScript.Geometry import *

clr.AddReference("RevitAPI") 
import Autodesk
from Autodesk.Revit.DB import* 
from Autodesk.Revit.DB.Structure import*

clr.AddReference('DSCoreNodes')
from DSCore.List import Flatten

clr.AddReference("RevitAPIUI") 
from Autodesk.Revit.UI import*

clr.AddReference("System") 
from System.Collections.Generic import List

clr.AddReference("RevitNodes")
import Revit
clr.ImportExtensions(Revit.Elements)
clr.ImportExtensions(Revit.GeometryConversion)

clr.AddReference("RevitServices")
import RevitServices
from RevitServices.Persistence import DocumentManager
from RevitServices.Transactions import TransactionManager

clr.AddReference("System.Windows.Forms")
clr.AddReference("System.Drawing")
clr.AddReference("System.Windows.Forms.DataVisualization")

import System.Windows.Forms 
from System.Windows.Forms import *
import System.Drawing
from System.Drawing import *
#endregion

#region ___Current doc/app/ui
doc = DocumentManager.Instance.CurrentDBDocument
uiapp = DocumentManager.Instance.CurrentUIApplication
app = uiapp.Application
uidoc = DocumentManager.Instance.CurrentUIApplication.ActiveUIDocument
view = doc.ActiveView
#endregion

#region ___someFunctions
def uwList(input):
    result = input if isinstance(input, list) else [input]
    return UnwrapElement(input)
def pullPointToCurve(mPipe, bPipe):
    #K = 304.8
    mPCurve = mPipe.Location.Curve
    nearestConOfBPipe =  closetConn(mPipe, bPipe)
    pMid = mPCurve.Project(nearestConOfBPipe).XYZPoint.ToPoint()
    #dynMP = Autodesk.DesignScript.Geometry.Point.ByCoordinates(pMid.X*K, pMid.Y*K, pMid.Z*K) 
    return pMid

def NearestConnector(ConnectorSet, curCurve):
    MinLength = float("inf")
    result = None  # Initialize result to None
    for n in ConnectorSet:
        distance = curCurve.Location.Curve.Distance(n.Origin)
        if distance < MinLength:
            MinLength = distance
            result = n
    return result

def closetConn(mPipe, bPipe):
    sortConnList = []
    originConns  = []
    tmp = []
    tmp1 = []
    tmp2 = []
    connList = list(bPipe.ConnectorManager.Connectors.GetEnumerator())
    nearConn = NearestConnector(connList, mPipe)
    tmp1.append(nearConn)
    farConn =  [c for c in connList  if c not in tmp1]
    tmp1.append([c for c in connList if c != nearConn])
    sortConnList = flatten(tmp1)
    tmp2.append([c.Origin.ToPoint() for c in sortConnList])
    originConns = flatten(tmp2)
    #XYZconn	= nearConn.Origin
    return originConns, sortConnList

def flatten(nestedList):
    flatList = []
    for item in nestedList:
        if isinstance(item, list):
            flatList.extend(flatten(item))
        else:
            flatList.append(item)
    return flatList
#endregion


mPipe   = uwList(IN[0])
bPipe	= uwList(IN[1])
# Do some action in a Transaction
TransactionManager.Instance.EnsureInTransaction(doc)


TransactionManager.Instance.TransactionTaskDone()

OUT = closetConn(mPipe,bPipe)
# ----------------------------------------
sortNearFarConnOfMainPipe = Python(IN[0]=pickBranchPipe, IN[1]=pickMainPipe)  # IronPython2
# ---------- sortNearFarConnOfMainPipe.python (115 lines) ----------
"""Copyright by: vudinhduybm@gmail.com"""
#region ___import all Library
import clr
import sys 
import System   
import math
import collections

sys.path.append('C:\Program Files\Autodesk\Revit 2022\AddIns\DynamoForRevit\IronPython.StdLib.2.7.9\duynamoLibrary')
from duynamoLibrary import *
clr.AddReference("ProtoGeometry")

from Autodesk.DesignScript.Geometry import *

clr.AddReference("RevitAPI") 
import Autodesk
from Autodesk.Revit.DB import* 
from Autodesk.Revit.DB.Structure import*

clr.AddReference('DSCoreNodes')
from DSCore.List import Flatten

clr.AddReference("RevitAPIUI") 
from Autodesk.Revit.UI import*

clr.AddReference("System") 
from System.Collections.Generic import List

clr.AddReference("RevitNodes")
import Revit
clr.ImportExtensions(Revit.Elements)
clr.ImportExtensions(Revit.GeometryConversion)

clr.AddReference("RevitServices")
import RevitServices
from RevitServices.Persistence import DocumentManager
from RevitServices.Transactions import TransactionManager

clr.AddReference("System.Windows.Forms")
clr.AddReference("System.Drawing")
clr.AddReference("System.Windows.Forms.DataVisualization")

import System.Windows.Forms 
from System.Windows.Forms import *
import System.Drawing
from System.Drawing import *
#endregion

#region ___Current doc/app/ui
doc = DocumentManager.Instance.CurrentDBDocument
uiapp = DocumentManager.Instance.CurrentUIApplication
app = uiapp.Application
uidoc = DocumentManager.Instance.CurrentUIApplication.ActiveUIDocument
view = doc.ActiveView
#endregion

#region ___someFunctions
def uwList(input):
    result = input if isinstance(input, list) else [input]
    return UnwrapElement(input)
def pullPointToCurve(mPipe, bPipe):
    #K = 304.8
    mPCurve = mPipe.Location.Curve
    nearestConOfBPipe =  closetConn(mPipe, bPipe)
    pMid = mPCurve.Project(nearestConOfBPipe).XYZPoint.ToPoint()
    #dynMP = Autodesk.DesignScript.Geometry.Point.ByCoordinates(pMid.X*K, pMid.Y*K, pMid.Z*K) 
    return pMid

def NearestConnector(ConnectorSet, curCurve):
    MinLength = float("inf")
    result = None  # Initialize result to None
    for n in ConnectorSet:
        distance = curCurve.Location.Curve.Distance(n.Origin)
        if distance < MinLength:
            MinLength = distance
            result = n
    return result

def closetConn(mPipe, bPipe):
    sortConnList = []
    originConns  = []
    tmp = []
    tmp1 = []
    tmp2 = []
    connList = list(bPipe.ConnectorManager.Connectors.GetEnumerator())
    nearConn = NearestConnector(connList, mPipe)
    tmp1.append(nearConn)
    farConn =  [c for c in connList  if c not in tmp1]
    tmp1.append([c for c in connList if c != nearConn])
    sortConnList = flatten(tmp1)
    tmp2.append([c.Origin.ToPoint() for c in sortConnList])
    originConns = flatten(tmp2)
    #XYZconn	= nearConn.Origin
    return originConns

def flatten(nestedList):
    flatList = []
    for item in nestedList:
        if isinstance(item, list):
            flatList.extend(flatten(item))
        else:
            flatList.append(item)
    return flatList
#endregion


mPipe   = uwList(IN[0])
bPipe	= uwList(IN[1])
# Do some action in a Transaction
TransactionManager.Instance.EnsureInTransaction(doc)


TransactionManager.Instance.TransactionTaskDone()

OUT = closetConn(mPipe,bPipe)
# ----------------------------------------
code_block_2 = CodeBlock(nearConn=sortNearFarConnOfMainPipe, farConn=sortNearFarConnOfMainPipe) { nearConn[0]; farConn[1]; }

code_block_3 = CodeBlock(originConns=sortNearFarConnOfBranchPipe, conns=sortNearFarConnOfBranchPipe) { originConns[0]; conns[1]; }
code_block_4 = CodeBlock(a=code_block_3.out1) { a[0]; }  # frozen

# group (continued): sort connector of 2 pipe
code_block_5 = CodeBlock(nearConn=code_block_3.out0, farConn=code_block_3.out0) { nearConn[0]; farConn[1]; }

# group: calculate to pull near conn of bPipe to mPipe
byTwoPoints = Vector.ByTwoPoints(start=code_block_5.out1, end=code_block_5.out0)
distanceOf2NearConns = Python(IN[0]=code_block_2.out0, IN[1]=code_block_5.out1)  # IronPython2
# ---------- distanceOf2NearConns.python (81 lines) ----------
"""Copyright by: vudinhduybm@gmail.com"""
#region ___import all Library
import clr
import sys 
import System   
import math
import collections

from math import *

sys.path.append('C:\Program Files\Autodesk\Revit 2022\AddIns\DynamoForRevit\IronPython.StdLib.2.7.9')
from duynamoLibrary import *

clr.AddReference("ProtoGeometry")
from Autodesk.DesignScript.Geometry import *

clr.AddReference("RevitAPI") 
import Autodesk
from Autodesk.Revit.DB import* 
from Autodesk.Revit.DB.Structure import*

clr.AddReference("DSCoreNodes")
from DSCore.List import Flatten

clr.AddReference("RevitAPIUI") 
from Autodesk.Revit.UI import*
from Autodesk.Revit.UI.Selection import ISelectionFilter

clr.AddReference("System") 
from System.Collections.Generic import List

clr.AddReference("RevitNodes")
import Revit
clr.ImportExtensions(Revit.Elements)
clr.ImportExtensions(Revit.GeometryConversion)

clr.AddReference("RevitServices")
import RevitServices
from RevitServices.Persistence import DocumentManager
from RevitServices.Transactions import TransactionManager

clr.AddReference("System.Windows.Forms")
clr.AddReference("System.Drawing")
clr.AddReference("System.Windows.Forms.DataVisualization")

import System.Windows.Forms 
from System.Windows.Forms import *
import System.Drawing
from System.Drawing import *
#endregion

#region ___Current doc/app/ui
doc = DocumentManager.Instance.CurrentDBDocument
uiapp = DocumentManager.Instance.CurrentUIApplication
app = uiapp.Application
uidoc = DocumentManager.Instance.CurrentUIApplication.ActiveUIDocument
view = doc.ActiveView
#endregion

#region ___someFunctions
def uwList(input):
    result = input if isinstance(input, list) else [input]
    return UnwrapElement(input)
def calculateDistance(pointA, pointB):
    dx = pointA.X - pointB.X
    dy = pointA.Y - pointB.Y
    dz = pointA.Z - pointB.Z
    distance = math.sqrt(dx**2 + dy**2 + dz**2)
    return distance
#endregion


p1   =  UnwrapElement(IN[0])
p2	 =	UnwrapElement(IN[1])
# Do some action in a Transaction
TransactionManager.Instance.EnsureInTransaction(doc)
dis  = calculateDistance(p1, p2)

TransactionManager.Instance.TransactionTaskDone()

OUT = dis
# ----------------------------------------
byTwoPoints_2 = Vector.ByTwoPoints(start=code_block_5.out1, end=code_block_2.out0)
calculateAngle = Python(IN[0]=byTwoPoints_2, IN[1]=byTwoPoints)  # IronPython2
# ---------- calculateAngle.python (99 lines) ----------
"""Copyright by: vudinhduybm@gmail.com"""
#region ___import all Library
import clr
import sys 
import System   
import math
import collections

from math import *

sys.path.append('C:\Program Files\Autodesk\Revit 2022\AddIns\DynamoForRevit\IronPython.StdLib.2.7.9')
from duynamoLibrary import *

clr.AddReference("ProtoGeometry")
from Autodesk.DesignScript.Geometry import *

clr.AddReference("RevitAPI") 
import Autodesk
from Autodesk.Revit.DB import* 
from Autodesk.Revit.DB.Structure import*

clr.AddReference("DSCoreNodes")
from DSCore.List import Flatten

clr.AddReference("RevitAPIUI") 
from Autodesk.Revit.UI import*
from Autodesk.Revit.UI.Selection import ISelectionFilter

clr.AddReference("System") 
from System.Collections.Generic import List

clr.AddReference("RevitNodes")
import Revit
clr.ImportExtensions(Revit.Elements)
clr.ImportExtensions(Revit.GeometryConversion)

clr.AddReference("RevitServices")
import RevitServices
from RevitServices.Persistence import DocumentManager
from RevitServices.Transactions import TransactionManager

clr.AddReference("System.Windows.Forms")
clr.AddReference("System.Drawing")
clr.AddReference("System.Windows.Forms.DataVisualization")

import System.Windows.Forms 
from System.Windows.Forms import *
import System.Drawing
from System.Drawing import *
#endregion

#region ___Current doc/app/ui
doc = DocumentManager.Instance.CurrentDBDocument
uiapp = DocumentManager.Instance.CurrentUIApplication
app = uiapp.Application
uidoc = DocumentManager.Instance.CurrentUIApplication.ActiveUIDocument
view = doc.ActiveView
#endregion

#region ___someFunctions
def uwList(input):
    result = input if isinstance(input, list) else [input]
    return UnwrapElement(input)
def calculateAngleBetweenPipes(v1, v2):
    #curve1 = mPipe.Location.Curve
    #v1 = curve1.GetEndPoint(1)-curve1.GetEndPoint(0)
    dir1 = v1.ToRevitType().Normalize()
    #curve2 = bPipe.Location.Curve
    #v2 = curve2.GetEndPoint(1)-curve2.GetEndPoint(0)
    dir2 = v2.ToRevitType().Normalize()
    
    dotProduct = dir1.DotProduct(dir2)
    mag1 = dir1.GetLength()
    mag2 = dir2.GetLength()
    cosAngle = dotProduct / (mag1 * mag2)
    angleRadians = acos(cosAngle)
    angleDegrees = degrees(angleRadians)
    angle1 = 180-angleDegrees
    minAngle = 0
    maxAngle = 0
    if angle1 < angleDegrees:
          minAngle = angle1
          maxAngle = angleDegrees
    else: 
          minAngle = angleDegrees
          maxAngle = angle1
    return minAngle,maxAngle
#endregion


v1   = UnwrapElement(IN[0])
v2   = UnwrapElement(IN[1])
# Do some action in a Transaction
TransactionManager.Instance.EnsureInTransaction(doc)


TransactionManager.Instance.TransactionTaskDone()

OUT = calculateAngleBetweenPipes(v1, v2)
# ----------------------------------------
code_block_6 = CodeBlock(a=calculateAngle) { a[0]; }

# group: pull near conn of bPipe to mPipe
tmpPoint1 = Python(IN[0]=code_block_5.out1, IN[1]=byTwoPoints, IN[2]=distanceOf2NearConns, IN[3]=code_block_6)  # IronPython2
# ---------- tmpPoint1.python (86 lines) ----------
"""Copyright by: vudinhduybm@gmail.com"""
#region ___import all Library
import clr
import sys 
import System   
import math
import collections

from math import *

sys.path.append('C:\Program Files\Autodesk\Revit 2022\AddIns\DynamoForRevit\IronPython.StdLib.2.7.9')
from duynamoLibrary import *

clr.AddReference("ProtoGeometry")
from Autodesk.DesignScript.Geometry import *

clr.AddReference("RevitAPI") 
import Autodesk
from Autodesk.Revit.DB import* 
from Autodesk.Revit.DB.Structure import*

clr.AddReference("DSCoreNodes")
from DSCore.List import Flatten

clr.AddReference("RevitAPIUI") 
from Autodesk.Revit.UI import*
from Autodesk.Revit.UI.Selection import ISelectionFilter

clr.AddReference("System") 
from System.Collections.Generic import List

clr.AddReference("RevitNodes")
import Revit
clr.ImportExtensions(Revit.Elements)
clr.ImportExtensions(Revit.GeometryConversion)

clr.AddReference("RevitServices")
import RevitServices
from RevitServices.Persistence import DocumentManager
from RevitServices.Transactions import TransactionManager

clr.AddReference("System.Windows.Forms")
clr.AddReference("System.Drawing")
clr.AddReference("System.Windows.Forms.DataVisualization")

import System.Windows.Forms 
from System.Windows.Forms import *
import System.Drawing
from System.Drawing import *
#endregion

#region ___Current doc/app/ui
doc = DocumentManager.Instance.CurrentDBDocument
uiapp = DocumentManager.Instance.CurrentUIApplication
app = uiapp.Application
uidoc = DocumentManager.Instance.CurrentUIApplication.ActiveUIDocument
view = doc.ActiveView
#endregion

#region ___someFunctions
def uwList(input):
    result = input if isinstance(input, list) else [input]
    return UnwrapElement(input)
def offsetPointAlongVector(point, vector, offsetDistance):
    direction = vector.ToRevitType().Normalize()
    scaledVector = direction.Multiply(offsetDistance).ToVector()
    offsetPoint = point.Add(scaledVector)
    return offsetPoint
def calculateDisplacement(inDis, inAngle):
    displacement = inDis * math.cos(math.radians(inAngle))
    return displacement
#endregion


inPoint   = UnwrapElement(IN[0])
inVector = UnwrapElement(IN[1])
inDis	= UnwrapElement(IN[2])
inAngle = UnwrapElement(IN[3])
# Do some action in a Transaction
TransactionManager.Instance.EnsureInTransaction(doc)
dis = calculateDisplacement(inDis, inAngle)
tmpPoint1 = offsetPointAlongVector(inPoint, inVector, dis)

TransactionManager.Instance.TransactionTaskDone()

OUT = tmpPoint1
# ----------------------------------------

reverse = Vector.Reverse(vector=byTwoPoints)

# group: user in put angle
code_block_7 = CodeBlock(data=boolean, waitfor=pickBranchPipe) { [data, waitfor]; }
userInputAngle = Python(IN[0]=code_block_7)  # IronPython2
# ---------- userInputAngle.python (68 lines) ----------
import clr
clr.AddReference('System.Windows.Forms')
clr.AddReference('System.Drawing')
from System.Windows.Forms import Form, Label, TextBox, Button, DialogResult
from System.Drawing import Point, Size

# Create a form
class MyForm(Form):
    def __init__(self):
        self.Text = 'inputAngle'
        self.Size = Size(350, 200)
        
        # Create and add label
        self.label = Label()
        self.label.Text = "Angle"
        self.label.Size = Size(260,20)
        self.label.Location = Point(10, 10)
        self.Controls.Add(self.label)
        
        # Create and add text box
        self.textBox = TextBox()
        self.textBox.Location = Point(10, 50)
        self.textBox.Size = Size(260, 20)
        self.Controls.Add(self.textBox)
        
        # Create and add OK button
        self.okButton = Button()
        self.okButton.Text = 'OK'
        self.okButton.Location = Point(10, 80)
        self.okButton.Click += self.okButton_Click
        self.Controls.Add(self.okButton)
        
        # Create and add Cancel button
        self.cancelButton = Button()
        self.cancelButton.Text = 'Cancel'
        self.cancelButton.Location = Point(100, 80)
        self.cancelButton.Click += self.cancelButton_Click
        self.Controls.Add(self.cancelButton)
        
        self.result = None

    def okButton_Click(self, sender, event):
        self.result = self.textBox.Text
        self.DialogResult = DialogResult.OK
        self.Close()

    def cancelButton_Click(self, sender, event):
        self.DialogResult = DialogResult.Cancel
        self.Close()

# Show the form and get the result
form = MyForm()
result = form.ShowDialog()

# Output the result if OK was clicked
if result == DialogResult.OK:
    text_input = form.result
else:
    text_input = None

angle = float(text_input)
desAng = None
if angle < 45 or angle == 45:
	desAng = 90 - angle
else:
	desAng = angle
# Assign the result to Dynamo output
OUT = angle
# ----------------------------------------
code_block_8 = CodeBlock(a=userInputAngle) { 90-a; }

# group: calculate dis between main pipe near conn and tmpPoint1
tmpLength = Python(IN[0]=tmpPoint1, IN[1]=code_block_2.out0, IN[2]=userInputAngle)  # IronPython2
# ---------- tmpLength.python (86 lines) ----------
"""Copyright by: vudinhduybm@gmail.com"""
#region ___import all Library
import clr
import sys 
import System   
import math
import collections

sys.path.append('C:\Program Files\Autodesk\Revit 2022\AddIns\DynamoForRevit\IronPython.StdLib.2.7.9\duynamoLibrary')
from duynamoLibrary import *
clr.AddReference("ProtoGeometry")

from Autodesk.DesignScript.Geometry import *

clr.AddReference("RevitAPI") 
import Autodesk
from Autodesk.Revit.DB import* 
from Autodesk.Revit.DB.Structure import*

clr.AddReference('DSCoreNodes')
from DSCore.List import Flatten

clr.AddReference("RevitAPIUI") 
from Autodesk.Revit.UI import*

clr.AddReference("System") 
from System.Collections.Generic import List

clr.AddReference("RevitNodes")
import Revit
clr.ImportExtensions(Revit.Elements)
clr.ImportExtensions(Revit.GeometryConversion)

clr.AddReference("RevitServices")
import RevitServices
from RevitServices.Persistence import DocumentManager
from RevitServices.Transactions import TransactionManager

clr.AddReference("System.Windows.Forms")
clr.AddReference("System.Drawing")
clr.AddReference("System.Windows.Forms.DataVisualization")

import System.Windows.Forms 
from System.Windows.Forms import *
import System.Drawing
from System.Drawing import *
#endregion

#region ___Current doc/app/ui
doc = DocumentManager.Instance.CurrentDBDocument
uiapp = DocumentManager.Instance.CurrentUIApplication
app = uiapp.Application
uidoc = DocumentManager.Instance.CurrentUIApplication.ActiveUIDocument
view = doc.ActiveView
#endregion

#region ___someFunctions
def uwList(input):
    result = input if isinstance(input, list) else [input]
    return UnwrapElement(input)
def calculateDistance(pointA, pointB):
    dx = pointA.X - pointB.X
    dy = pointA.Y - pointB.Y
    dz = pointA.Z - pointB.Z
    distance = math.sqrt(dx**2 + dy**2 + dz**2)
    return distance
def roundToNearestFive(number):
    remainder = number % 5
    if remainder == 0:
        return number
    return number + (5 - remainder)
#endregion


tmpPoint1   = uwList(IN[0])
pulledPoint = uwList(IN[1])
angle = uwList(IN[2])

# Do some action in a Transaction
TransactionManager.Instance.EnsureInTransaction(doc)
dis1 = calculateDistance(tmpPoint1, pulledPoint)
angRad = math.radians(angle)
tmpDis = dis1*math.tan(angRad)
TransactionManager.Instance.TransactionTaskDone()

OUT = round(tmpDis)
# ----------------------------------------

# group: offset tmpPoint1 along bPipe(tmpPipe2 is also bPipe near conn new location)
tmpPoint2 = Python(IN[0]=tmpPoint1, IN[1]=reverse, IN[2]=tmpLength)  # IronPython2
# ---------- tmpPoint2.python (81 lines) ----------
"""Copyright by: vudinhduybm@gmail.com"""
#region ___import all Library
import clr
import sys 
import System   
import math
import collections

from math import *

sys.path.append('C:\Program Files\Autodesk\Revit 2022\AddIns\DynamoForRevit\IronPython.StdLib.2.7.9')
from duynamoLibrary import *

clr.AddReference("ProtoGeometry")
from Autodesk.DesignScript.Geometry import *

clr.AddReference("RevitAPI") 
import Autodesk
from Autodesk.Revit.DB import* 
from Autodesk.Revit.DB.Structure import*

clr.AddReference("DSCoreNodes")
from DSCore.List import Flatten

clr.AddReference("RevitAPIUI") 
from Autodesk.Revit.UI import*
from Autodesk.Revit.UI.Selection import ISelectionFilter

clr.AddReference("System") 
from System.Collections.Generic import List

clr.AddReference("RevitNodes")
import Revit
clr.ImportExtensions(Revit.Elements)
clr.ImportExtensions(Revit.GeometryConversion)

clr.AddReference("RevitServices")
import RevitServices
from RevitServices.Persistence import DocumentManager
from RevitServices.Transactions import TransactionManager

clr.AddReference("System.Windows.Forms")
clr.AddReference("System.Drawing")
clr.AddReference("System.Windows.Forms.DataVisualization")

import System.Windows.Forms 
from System.Windows.Forms import *
import System.Drawing
from System.Drawing import *
#endregion

#region ___Current doc/app/ui
doc = DocumentManager.Instance.CurrentDBDocument
uiapp = DocumentManager.Instance.CurrentUIApplication
app = uiapp.Application
uidoc = DocumentManager.Instance.CurrentUIApplication.ActiveUIDocument
view = doc.ActiveView
#endregion

#region ___someFunctions
def uwList(input):
    result = input if isinstance(input, list) else [input]
    return UnwrapElement(input)
def offsetPointAlongVector(point, vector, offsetDistance):
    direction = vector.ToRevitType().Normalize()
    scaledVector = direction.Multiply(offsetDistance).ToVector()
    offsetPoint = point.Add(scaledVector)
    return offsetPoint
#endregion


inPoint   = uwList(IN[0])
inVector	= uwList(IN[1])
inDis	= uwList(IN[2])
# Do some action in a Transaction
TransactionManager.Instance.EnsureInTransaction(doc)
tmpPoint2 = offsetPointAlongVector(inPoint, inVector, inDis)

TransactionManager.Instance.TransactionTaskDone()

OUT = tmpPoint2
# ----------------------------------------

# group: set branch pipe connector new location
code_block_9 = CodeBlock(nearConnOfBranchPipe=code_block_4) { nearConnOfBranchPipe; }
code_block_10 = CodeBlock(tmpPoint2=tmpPoint2) { tmpPoint2; }
setNewLocationOfNearConnOfBranchPipe = Python(IN[0]=code_block_9, IN[1]=code_block_10)  # IronPython2; frozen
# ---------- setNewLocationOfNearConnOfBranchPipe.python (116 lines) ----------
"""Copyright by: vudinhduybm@gmail.com"""
#region ___import all Library
import clr
import sys 
import System   
import math
import collections

sys.path.append('C:\Program Files\Autodesk\Revit 2022\AddIns\DynamoForRevit\IronPython.StdLib.2.7.9\duynamoLibrary')
from duynamoLibrary import *
clr.AddReference("ProtoGeometry")

from Autodesk.DesignScript.Geometry import *

clr.AddReference("RevitAPI") 
import Autodesk
from Autodesk.Revit.DB import* 
from Autodesk.Revit.DB.Structure import*

clr.AddReference('DSCoreNodes')
from DSCore.List import Flatten

clr.AddReference("RevitAPIUI") 
from Autodesk.Revit.UI import*

clr.AddReference("System") 
from System.Collections.Generic import List

clr.AddReference("RevitNodes")
import Revit
clr.ImportExtensions(Revit.Elements)
clr.ImportExtensions(Revit.GeometryConversion)

clr.AddReference("RevitServices")
import RevitServices
from RevitServices.Persistence import DocumentManager
from RevitServices.Transactions import TransactionManager

clr.AddReference("System.Windows.Forms")
clr.AddReference("System.Drawing")
clr.AddReference("System.Windows.Forms.DataVisualization")

import System.Windows.Forms 
from System.Windows.Forms import *
import System.Drawing
from System.Drawing import *
#endregion

#region ___Current doc/app/ui
doc = DocumentManager.Instance.CurrentDBDocument
uiapp = DocumentManager.Instance.CurrentUIApplication
app = uiapp.Application
uidoc = DocumentManager.Instance.CurrentUIApplication.ActiveUIDocument
view = doc.ActiveView
#endregion

#region ___someFunctions
def uwList(input):
    result = input if isinstance(input, list) else [input]
    return UnwrapElement(input)
def move_connector(connector, new_location):
    new_connector = None
    # Start a transaction
    TransactionManager.Instance.EnsureInTransaction(doc)
    
    try:
        # Get the MEP element that hosts the connector
        host_element = connector.Owner

        # Verify that the host element supports connectors
        if not hasattr(host_element, 'MEPModel') or not host_element.MEPModel:
            raise Exception("Host element does not support MEP connections.")
        
        # Get the existing connectors on the host element
        connectors = host_element.MEPModel.ConnectorManager.Connectors

        # Create a new connector at the new location
        new_connector = ConnectorElement.CreatePipeConnector(doc, new_location)
        
        # Set properties of the new connector (if needed)
        # Example: Copy properties from the old connector
        new_connector.SetSystemClassification(connector.Domain)
        new_connector.SetDirection(connector.Direction)
        new_connector.SetDiameter(connector.Radius * 2)  # SetDiameter expects diameter, not radius

        # Transfer any connections to the new connector
        for conn in connectors:
            if conn.Id == connector.Id:
                continue  # Skip the old connector itself
            if connector.IsConnectedTo(conn):
                connector.DisconnectFrom(conn)
                new_connector.ConnectTo(conn)

        # Remove the old connector
        doc.Delete(connector.Id)
        
        print("Connector moved successfully.")
    except Exception as e:
        print("Error moving connector:", str(e))
    
    # Commit the transaction
    TransactionManager.Instance.TransactionTaskDone()
    
    return new_connector
#endregion


nearConn   = UnwrapElement(IN[0])
tmpPoint2 = UnwrapElement(IN[1])
# Do some action in a Transaction
TransactionManager.Instance.EnsureInTransaction(doc)


TransactionManager.Instance.TransactionTaskDone()

OUT = move_connector(nearConn.ToRevitType(), tmpPoint2.ToRevitType())
# ----------------------------------------

# group: create tmpPipe
code_block_11 = CodeBlock(mPipeNearConn=code_block_2.out0) { mPipeNearConn; }
list_create = List.Create(item0=tmpPoint2, item1=code_block_11)
code_block_12 = CodeBlock(bPipe=pickMainPipe) { bPipe; }
tmpPipe = Python(IN[0]=list_create, IN[1]=code_block_12)  # IronPython2
# ---------- tmpPipe.python (143 lines) ----------
"""Copyright by: vudinhduybm@gmail.com"""
#region ___import all Library
import clr
import sys 
import System   
import math
import collections

from math import *

sys.path.append('C:\Program Files\Autodesk\Revit 2022\AddIns\DynamoForRevit\IronPython.StdLib.2.7.9')
from duynamoLibrary import *

clr.AddReference("ProtoGeometry")
from Autodesk.DesignScript.Geometry import *

clr.AddReference("RevitAPI") 
import Autodesk
from Autodesk.Revit.DB import* 
from Autodesk.Revit.DB.Structure import*

clr.AddReference("DSCoreNodes")
from DSCore.List import Flatten

clr.AddReference("RevitAPIUI") 
from Autodesk.Revit.UI import*
from Autodesk.Revit.UI.Selection import ISelectionFilter

clr.AddReference("System") 
from System.Collections.Generic import List

clr.AddReference("RevitNodes")
import Revit
clr.ImportExtensions(Revit.Elements)
clr.ImportExtensions(Revit.GeometryConversion)

clr.AddReference("RevitServices")
import RevitServices
from RevitServices.Persistence import DocumentManager
from RevitServices.Transactions import TransactionManager

clr.AddReference("System.Windows.Forms")
clr.AddReference("System.Drawing")
clr.AddReference("System.Windows.Forms.DataVisualization")

import System.Windows.Forms 
from System.Windows.Forms import *
import System.Drawing
from System.Drawing import *
#endregion

#region ___Current doc/app/ui
doc = DocumentManager.Instance.CurrentDBDocument
uiapp = DocumentManager.Instance.CurrentUIApplication
app = uiapp.Application
uidoc = DocumentManager.Instance.CurrentUIApplication.ActiveUIDocument
view = doc.ActiveView
#endregion

#region ___someFunctions
def uwList(input):
    result = input if isinstance(input, list) else [input]
    return UnwrapElement(input)
def pipeCreateFromPoints(desPointsList, sel_pipingSystem, sel_PipeType, sel_Level, diameter):
    lst_Points1 = [i for i in desPointsList]
    lst_Points2 = [i for i in desPointsList[1:]]
    linesList = []
    for pt1, pt2 in zip(lst_Points1,lst_Points2):
        line =  Autodesk.DesignScript.Geometry.Line.ByStartPointEndPoint(pt1,pt2)
        linesList.append(line)
    firstPoint   = [x.StartPoint for x in linesList]
    secondPoint  = [x.EndPoint for x in linesList]
    pipesList = []
    pipesList1 = []
    TransactionManager.Instance.EnsureInTransaction(doc)
    for i,x in enumerate(firstPoint):
        try:
            levelId = sel_Level.Id
            sysTypeId = sel_pipingSystem.Id
            pipeTypeId = sel_PipeType.Id
            diam = diameter
            pipe = Autodesk.Revit.DB.Plumbing.Pipe.Create(doc,sysTypeId,pipeTypeId,levelId,x.ToXyz(),secondPoint[i].ToXyz())
            param_Diameter = pipe.get_Parameter(BuiltInParameter.RBS_PIPE_DIAMETER_PARAM)
            param_Diameter.SetValueString(diam.ToString())
            TransactionManager.Instance.EnsureInTransaction(doc)
            pipesList.append(pipe.ToDSType(False))
            pipesList1.append(pipe)
            # param_Length.Set()
            TransactionManager.Instance.TransactionTaskDone()
        except:
            pipesList.append(None)				
    TransactionManager.Instance.TransactionTaskDone()
    return pipesList
	
def getPipeParameter(p):
    paramDiameters = []
    paramPipingSystems = []
    paramLevels = []
    paramPipeTypes = []

    paramDiameter = p.get_Parameter(BuiltInParameter.RBS_PIPE_DIAMETER_PARAM).AsDouble() * 304.8
    
    paramPipeTypeId = p.GetTypeId()
    paramPipeType = doc.GetElement(paramPipeTypeId)
    paramPipeTypes.append(paramPipeType)
    pipeTypeName = paramPipeType.LookupParameter("Type Name").AsString()
	
    paramPipingSystemId = p.get_Parameter(BuiltInParameter.RBS_PIPING_SYSTEM_TYPE_PARAM).AsElementId()
    paramPipingSystem = doc.GetElement(paramPipingSystemId)
    paramPipingSystems.append(paramPipingSystem)
    pipingSystemName = paramPipingSystem.LookupParameter("System Classification").AsValueString()

    paramLevelId = p.get_Parameter(BuiltInParameter.RBS_START_LEVEL_PARAM).AsElementId()
    paramLevel = doc.GetElement(paramLevelId)
    paramLevels.append(paramLevel)

    return [paramDiameter, paramPipingSystem, paramPipeType, paramLevel],[paramDiameter,pipingSystemName,pipeTypeName,paramLevel]
    
def flatten(nestedList):
    flatList = []
    for item in nestedList:
        if isinstance(item, list):
            flatList.extend(flatten(item))
        else:
            flatList.append(item)
    return flatList
#endregion


pointList   = uwList(IN[0])
basePipe    = uwList(IN[1])

# Do some action in a Transaction
TransactionManager.Instance.EnsureInTransaction(doc)
basePipeParam = getPipeParameter(basePipe)
diamParam = basePipeParam[0][0]
pipingSystemParam = basePipeParam[0][1]
pipeTypeParam = basePipeParam[0][2]
levelParam = basePipeParam[0][3]
tempPipe = pipeCreateFromPoints(pointList, pipingSystemParam, pipeTypeParam, levelParam, diamParam)
TransactionManager.Instance.TransactionTaskDone()

OUT = flatten(tempPipe)
# ----------------------------------------

code_block_13 = CodeBlock(data=code_block_9, waitfor=tmpPipe) { [data,waitfor][0]; }
setNewLocationOfNearConnOfBranchPipe_2 = Python(IN[0]=code_block_13, IN[1]=code_block_10)  # IronPython2; frozen
# ---------- setNewLocationOfNearConnOfBranchPipe_2.python (127 lines) ----------
"""Copyright by: vudinhduybm@gmail.com"""
#region ___import all Library
import clr
import sys 
import System   
import math
import collections

sys.path.append('C:\Program Files\Autodesk\Revit 2022\AddIns\DynamoForRevit\IronPython.StdLib.2.7.9\duynamoLibrary')
from duynamoLibrary import *
clr.AddReference("ProtoGeometry")

from Autodesk.DesignScript.Geometry import *

clr.AddReference("RevitAPI") 
import Autodesk
from Autodesk.Revit.DB import* 
from Autodesk.Revit.DB.Structure import*

clr.AddReference('DSCoreNodes')
from DSCore.List import Flatten

clr.AddReference("RevitAPIUI") 
from Autodesk.Revit.UI import*

clr.AddReference("System") 
from System.Collections.Generic import List

clr.AddReference("RevitNodes")
import Revit
clr.ImportExtensions(Revit.Elements)
clr.ImportExtensions(Revit.GeometryConversion)

clr.AddReference("RevitServices")
import RevitServices
from RevitServices.Persistence import DocumentManager
from RevitServices.Transactions import TransactionManager

clr.AddReference("System.Windows.Forms")
clr.AddReference("System.Drawing")
clr.AddReference("System.Windows.Forms.DataVisualization")

import System.Windows.Forms 
from System.Windows.Forms import *
import System.Drawing
from System.Drawing import *
#endregion

#region ___Current doc/app/ui
doc = DocumentManager.Instance.CurrentDBDocument
uiapp = DocumentManager.Instance.CurrentUIApplication
app = uiapp.Application
uidoc = DocumentManager.Instance.CurrentUIApplication.ActiveUIDocument
view = doc.ActiveView
#endregion

#region ___someFunctions
def uwList(input):
    result = input if isinstance(input, list) else [input]
    return UnwrapElement(input)
def move_connector(connector, new_location):
    new_connector = None
    updated_pipe = None
    # Start a transaction
    TransactionManager.Instance.EnsureInTransaction(doc)
    
    try:
        # Get the MEP element that hosts the connector
        host_element = connector.Owner

        # Verify that the host element supports connectors
        if not hasattr(host_element, 'MEPModel') or not host_element.MEPModel:
            raise Exception("Host element does not support MEP connections.")
        
        # Get the existing connectors on the host element
        connectors = host_element.MEPModel.ConnectorManager.Connectors

        # Create a new connector at the new location
        new_connector = ConnectorElement.CreatePipeConnector(doc, new_location)
        
        # Set properties of the new connector (if needed)
        # Example: Copy properties from the old connector
        new_connector.SetSystemClassification(connector.Domain)
        new_connector.SetDirection(connector.Direction)
        new_connector.SetDiameter(connector.Radius * 2)  # SetDiameter expects diameter, not radius

        # Transfer any connections to the new connector
        for ref in connector.AllRefs:
            if ref.HasConnector:
                # Assuming the reference element is the pipe
                pipe = ref.Element
                if isinstance(pipe, Pipe):
                    # Check which end of the pipe needs to be updated
                    start_conn = pipe.ConnectorManager.Lookup(0)
                    end_conn = pipe.ConnectorManager.Lookup(1)
                    
                    if start_conn.Id == connector.Id:
                        start_conn.DisconnectAll()
                        pipe.Location.Curve = Line.CreateBound(new_location, end_conn.Origin)
                        start_conn.ConnectTo(new_connector)
                    elif end_conn.Id == connector.Id:
                        end_conn.DisconnectAll()
                        pipe.Location.Curve = Line.CreateBound(start_conn.Origin, new_location)
                        end_conn.ConnectTo(new_connector)
                    updated_pipe = pipe

        # Remove the old connector
        connector.DisconnectAll()
        doc.Delete(connector.Id)
    except Exception as e:
        pass
    # Commit the transaction
    TransactionManager.Instance.TransactionTaskDone()
    
    return updated_pipe
#endregion


nearConn   = UnwrapElement(IN[0])
tmpPoint2 = UnwrapElement(IN[1])
# Do some action in a Transaction
TransactionManager.Instance.EnsureInTransaction(doc)


TransactionManager.Instance.TransactionTaskDone()

OUT = move_connector(nearConn, tmpPoint2)
# ----------------------------------------
code_block_14 = CodeBlock {  }

# group: trim 3 pipe by Elbow
code_block_15 = CodeBlock(mPipe=pickMainPipe, bPipe=pickBranchPipe) { mPipe; bPipe; }
list_create_2 = List.Create(item0=code_block_15.mPipe, item1=tmpPipe, item2=code_block_15.bPipe)
code_block_16 = CodeBlock(c=list_create_2) { List.Flatten(c); }
connect_tmpPipeAndBranchPipeByElbow = Python(IN[0]=code_block_16)  # IronPython2
# ---------- connect_tmpPipeAndBranchPipeByElbow.python (108 lines) ----------
"""Copyright by: vudinhduybm@gmail.com"""
#region ___import all Library
import clr
import sys 
import System   
import math
import collections

from math import *

sys.path.append('C:\Program Files\Autodesk\Revit 2022\AddIns\DynamoForRevit\IronPython.StdLib.2.7.9')
from duynamoLibrary import *

clr.AddReference("ProtoGeometry")
from Autodesk.DesignScript.Geometry import *

clr.AddReference("RevitAPI") 
import Autodesk
from Autodesk.Revit.DB import* 
from Autodesk.Revit.DB.Structure import*

clr.AddReference("DSCoreNodes")
from DSCore.List import Flatten

clr.AddReference("RevitAPIUI") 
from Autodesk.Revit.UI import*
from Autodesk.Revit.UI.Selection import ISelectionFilter

clr.AddReference("System") 
from System.Collections.Generic import List

clr.AddReference("RevitNodes")
import Revit
clr.ImportExtensions(Revit.Elements)
clr.ImportExtensions(Revit.GeometryConversion)

clr.AddReference("RevitServices")
import RevitServices
from RevitServices.Persistence import DocumentManager
from RevitServices.Transactions import TransactionManager

clr.AddReference("System.Windows.Forms")
clr.AddReference("System.Drawing")
clr.AddReference("System.Windows.Forms.DataVisualization")

import System.Windows.Forms 
from System.Windows.Forms import *
import System.Drawing
from System.Drawing import *
#endregion

#region ___Current doc/app/ui
doc = DocumentManager.Instance.CurrentDBDocument
uiapp = DocumentManager.Instance.CurrentUIApplication
app = uiapp.Application
uidoc = DocumentManager.Instance.CurrentUIApplication.ActiveUIDocument
view = doc.ActiveView
#endregion

#region ___someFunctions
def uwList(input):
    result = input if isinstance(input, list) else [input]
    return UnwrapElement(input)
def createElbow(doc, pipes):
	connectors = []
	elbowList = []
	try:
		for pipe in pipes:
			connectors.append(pipe.ConnectorManager.Connectors)
	except:
		pass

	TransactionManager.Instance.EnsureInTransaction(doc)
	
	try:
		for set1, set2 in zip(connectors[:-1], connectors[1:]):
			conStart = list(set1)
			conEnd = list(set2)
			d1 = conStart[0].Origin.DistanceTo(conEnd[0].Origin)*conStart[0].Origin.DistanceTo(conEnd[1].Origin)
			d2 = conStart[1].Origin.DistanceTo(conEnd[0].Origin)*conStart[1].Origin.DistanceTo(conEnd[1].Origin)
			i = 0
			if d1 > d2:
				i = 1
	
			d3 = conEnd[0].Origin.DistanceTo(conStart[0].Origin)*conEnd[0].Origin.DistanceTo(conStart[1].Origin)
			d4 = conEnd[1].Origin.DistanceTo(conStart[0].Origin)*conEnd[1].Origin.DistanceTo(conStart[1].Origin)
			j = 0
			if d3 > d4:
				j = 1
	
			fitting = doc.Create.NewElbowFitting(conStart[i],conEnd[j])
			elbowList.append(fitting)
	except:
		pass

	return elbowList
#endregion


pipeList   = uwList(IN[0])

# Do some action in a Transaction
TransactionManager.Instance.EnsureInTransaction(doc)
elbow = createElbow(doc, pipeList)

TransactionManager.Instance.TransactionTaskDone()

OUT = elbow
# ----------------------------------------
