# Dynamo graph connect 2 Par Pipe_script.dyn (Dynamo 2.19.3.6394)

# group: pick main pipe and branch pipe
boolean = BoolSelector(true)  # frozen
pickMainPipe = Python(IN[0]=boolean)  # IronPython2
# ---------- pickMainPipe.python (72 lines) ----------
"""Copyright by: vudinhduybm@gmail.com"""
#region ___import all Library
import clr
import sys 
import System   
import math
import collections


clr.AddReference("ProtoGeometry")

from Autodesk.DesignScript.Geometry import *

clr.AddReference("RevitAPI") 
import Autodesk
from Autodesk.Revit.DB import* 
from Autodesk.Revit.DB.Structure import*

clr.AddReference("RevitAPIUI") 
from Autodesk.Revit.UI import*

clr.AddReference("System") 
from System.Collections.Generic import List

clr.AddReference("RevitNodes")
import Revit
clr.ImportExtensions(Revit.Elements)
clr.ImportExtensions(Revit.GeometryConversion)

clr.AddReference("RevitServices")
import RevitServices
from RevitServices.Persistence import DocumentManager
from RevitServices.Transactions import TransactionManager
from Autodesk.Revit.UI.Selection import ObjectType
clr.AddReference("System.Windows.Forms")
clr.AddReference("System.Drawing")
clr.AddReference("System.Windows.Forms.DataVisualization")

import System.Windows.Forms 
from System.Windows.Forms import *
import System.Drawing
from System.Drawing import *
#endregion

#region ___Current doc/app/ui
doc = DocumentManager.Instance.CurrentDBDocument
uiapp = DocumentManager.Instance.CurrentUIApplication
app = uiapp.Application
uidoc = DocumentManager.Instance.CurrentUIApplication.ActiveUIDocument
view = doc.ActiveView
#endregion

#region ___someFunctions
def uwList(input):
    result = input if isinstance(input, list) else [input]
    return UnwrapElement(input)
def PickObjects():
    ref = uidoc.Selection.PickObject(ObjectType.Element)
    eles =  doc.GetElement(ref.ElementId)
    return  eles
#endregion


eleList   = uwList(IN[0])

# Do some action in a Transaction
TransactionManager.Instance.EnsureInTransaction(doc)


TransactionManager.Instance.TransactionTaskDone()

OUT = PickObjects()
# ----------------------------------------
code_block = CodeBlock(data=boolean, waitfor=pickMainPipe) { [data, waitfor]; }
pickBranchPipe = Python(IN[0]=code_block)  # IronPython2; same code as pickMainPipe

# group: user in put angle
code_block_2 = CodeBlock(data=boolean, waitfor=pickBranchPipe) { [data, waitfor]; }
userInputAngle = Python(IN[0]=code_block_2)  # IronPython2
# ---------- userInputAngle.python (123 lines) ----------
"""Copyright by: vudinhduybm@gmail.com"""
#region ___import all Library
import clr
import sys 
import System   
import math
import collections

clr.AddReference("ProtoGeometry")

from Autodesk.DesignScript.Geometry import *

clr.AddReference("RevitAPI") 
import Autodesk
from Autodesk.Revit.DB import* 
from Autodesk.Revit.DB.Structure import*
from Autodesk.Revit.DB import Line, XYZ, IntersectionResultArray, SetComparisonResult

clr.AddReference("RevitAPIUI") 
from Autodesk.Revit.UI.Selection import ISelectionFilter
from Autodesk.Revit.UI import*

clr.AddReference("System") 
from System.Collections.Generic import List

clr.AddReference("RevitNodes")
import Revit
clr.ImportExtensions(Revit.Elements)
clr.ImportExtensions(Revit.GeometryConversion)

clr.AddReference("RevitServices")
import RevitServices
from RevitServices.Persistence import DocumentManager
from RevitServices.Transactions import TransactionManager

clr.AddReference("System.Windows.Forms")
clr.AddReference("System.Drawing")
clr.AddReference("System.Windows.Forms.DataVisualization")

import System.Windows.Forms 
from System.Windows.Forms import *
import System.Drawing
from System.Drawing import *

#Application.SetHighDpiMode(System.Windows.Forms.HighDpiMode.SystemAware)
# Create a form
class MyForm(Form):
    def __init__(self):
        #NOTE: Để tạo UI có kích thước tương đối so với màn hình làm việc
            #  Ta dùng Screen.PrimaryScreen.WorkingArea
        primary_screen = Screen.PrimaryScreen.WorkingArea
        screen_width = primary_screen.Width // 5
        screen_height = primary_screen.Height // 6
        self.Text = ''
        self.ClientSize = Size(screen_width, screen_height)
        self.Font = System.Drawing.Font("Meiryo UI", 7.5, System.Drawing.FontStyle.Bold, System.Drawing.GraphicsUnit.Point, 128)
        self.ForeColor = System.Drawing.Color.Red     
        # Create and add label
        self.label = Label()
        self.label.Text = "ANGLE"
        self.label.Size = Size(screen_width // 2, 50)
        self.label.Location = Point(20, 20)
        self.Controls.Add(self.label)
        # Create and add text box
        self.textBox = TextBox()
        self.textBox.Location = Point(30, 70)
        self.textBox.Size = Size(screen_width // 1.1, 200)
        self.textBox.KeyDown += self.textBox_KeyDown
        self.Controls.Add(self.textBox)
        
        # Create and add OK button
        self.okButton = Button()
        self.okButton.Text = 'OK'
        self.okButton.Size = Size(150,40)
        self.okButton.Location = Point(screen_width - 350, 
                                       screen_height - 70)
        self.okButton.Click += self.okButton_Click
        self.Controls.Add(self.okButton)
        # Create and add Cancel button
        self.cancelButton = Button()
        self.cancelButton.Text = 'CANCLE'
        self.cancelButton.Size = Size(150,40)
        self.cancelButton.Location = Point(screen_width - 180, 
                                           screen_height - 70)
        self.cancelButton.Click += self.cancelButton_Click
        self.Controls.Add(self.cancelButton)
        self.fvcLabel = Label()
        self.fvcLabel.Text = "@FVC"
        self.fvcLabel.Size = Size(150, 40)
        self.fvcLabel.Location = Point(20, screen_height - 50)  # Bottom left corner
        self.Controls.Add(self.fvcLabel)        
        # self.FormBorderStyle = System.Windows.Forms.FormBorderStyle.Fixed3D
        self.result = None
        ###
    def textBox_KeyDown(self, sender, event):
            if event.KeyCode == Keys.Enter:
                self.okButton_Click(sender, None)  # Gọi cùng logic của OK
                event.Handled = True        
    def okButton_Click(self, sender, event):
        self.result = self.textBox.Text
        self.DialogResult = DialogResult.OK
        self.Close()
    def cancelButton_Click(self, sender, event):
        self.DialogResult = DialogResult.Cancel
        self.Close()
# Show the form and get the result
form = MyForm()
result = form.ShowDialog()

# Output the result if OK was clicked
if result == DialogResult.OK:
    text_input = form.result
else:
    text_input = None

angle = float(text_input)
desAng = None
if angle <= 45 :
	desAng = 90 - angle
else:
	desAng = angle
# Assign the result to Dynamo output
OUT = angle
# ----------------------------------------

# group: create tmp Pipe
nearfarconns_bp_mp = Python(IN[0]=pickMainPipe, IN[1]=pickBranchPipe, IN[2]=userInputAngle)  # IronPython2
# ---------- nearfarconns_bp_mp.python (147 lines) ----------
"""Copyright by: vudinhduybm@gmail.com"""
#region ___import all Library
import clr
import sys 
import System   
import math
import collections

clr.AddReference("ProtoGeometry")
from math import *
from Autodesk.DesignScript.Geometry import *

clr.AddReference("RevitAPI") 
import Autodesk
from Autodesk.Revit.DB import* 
from Autodesk.Revit.DB.Structure import*

clr.AddReference("RevitAPIUI") 
from Autodesk.Revit.UI import*

clr.AddReference("System") 
from System.Collections.Generic import List

clr.AddReference("RevitNodes")
import Revit
clr.ImportExtensions(Revit.Elements)
clr.ImportExtensions(Revit.GeometryConversion)

clr.AddReference("RevitServices")
import RevitServices
from RevitServices.Persistence import DocumentManager
from RevitServices.Transactions import TransactionManager

clr.AddReference("System.Windows.Forms")
clr.AddReference("System.Drawing")
clr.AddReference("System.Windows.Forms.DataVisualization")

import System.Windows.Forms 
from System.Windows.Forms import *
import System.Drawing
from System.Drawing import *
#endregion

#region ___Current doc/app/ui
doc = DocumentManager.Instance.CurrentDBDocument
uiapp = DocumentManager.Instance.CurrentUIApplication
app = uiapp.Application
uidoc = DocumentManager.Instance.CurrentUIApplication.ActiveUIDocument
view = doc.ActiveView
#endregion

#region ___someFunctions
def uwList(input):
    result = input if isinstance(input, list) else [input]
    return UnwrapElement(input)
    originConns = flatten(tmp2)
def NearestConnector(ConnectorSet, curCurve):
    MinLength = float("inf")
    result = None  # Initialize result to None
    for n in ConnectorSet:
        distance = curCurve.Location.Curve.Distance(n.Origin)
        if distance < MinLength:
            MinLength = distance
            result = n
    return result    
    
def closetConn(firstPipe, secondPipe): #return nearest connector of secondPipe to firstPipe
    connectors1 = list(secondPipe.ConnectorManager.Connectors.GetEnumerator())
    Connector1 = NearestConnector(connectors1, firstPipe)
    XYZconn	= Connector1.Origin
    return XYZconn
    
    
def sortConnsOf1stPipe_To2ndPipe(firstPipe, secondPipe):
    sortConnList = []
    originConns  = []
    tmp = []
    tmp1 = []
    tmp2 = []
    connList = list(firstPipe.ConnectorManager.Connectors.GetEnumerator())
    nearConn = NearestConnector(connList, secondPipe)
    tmp1.append(nearConn)
    farConn =  [c for c in connList  if c not in tmp1]
    tmp1.append([c for c in connList if c != nearConn])
    sortConnList = flatten(tmp1)
    tmp2.append([c.Origin for c in sortConnList])
    originConns = flatten(tmp2)
    return originConns

def pullPointToCurve(mPipe, bPipe):
    mPCurve = mPipe.Location.Curve
    nearestConOfBPipe =  closetConn(mPipe, bPipe)
    pMid = mPCurve.Project(nearestConOfBPipe).XYZPoint
    return pMid
def calculateDistance(pointA, pointB):
    dx = pointA.X - pointB.X
    dy = pointA.Y - pointB.Y
    dz = pointA.Z - pointB.Z
    distance = math.sqrt(dx**2 + dy**2 + dz**2)
    return distance
def offsetPointAlongVector(point, vector, offsetDistance):
    direction = vector.Normalize()
    scaledVector = direction.Multiply(offsetDistance)
    offsetPoint = point.Add(scaledVector)
    return offsetPoint
def flatten(nestedList):
    flatList = []
    for item in nestedList:
        if isinstance(item, list):
            flatList.extend(flatten(item))
        else:
            flatList.append(item)
    return flatList
#endregion
firstPipe   = UnwrapElement(IN[0])
secondPipe	= UnwrapElement(IN[1])
inAngle = UnwrapElement(IN[2])
# Do some action in a Transaction
TransactionManager.Instance.EnsureInTransaction(doc)
nf_firstPipeConns = sortConnsOf1stPipe_To2ndPipe(firstPipe, secondPipe)
nf_secondPipeConns = sortConnsOf1stPipe_To2ndPipe(secondPipe, firstPipe)
#project near conn of second Pipe to first Pipe
#to ensure can project 
secondPipeCurve = secondPipe.Location.Curve
vector1 = nf_secondPipeConns[0]-nf_secondPipeConns[1]
new_nearConnOf2ndPipe = offsetPointAlongVector(nf_secondPipeConns[1], vector1, 1000)
line1 = Line.CreateBound(nf_secondPipeConns[1], new_nearConnOf2ndPipe)
projectPoint = line1.Project(nf_firstPipeConns[0]).XYZPoint
###
dis = calculateDistance(projectPoint, nf_firstPipeConns[0])
offsetVector = nf_secondPipeConns[1] - projectPoint
if inAngle <= 45:
	angle = 90 - inAngle
	angRad = math.radians(angle)
	offsetDis = dis*tan(angRad)
	tmpPoint = offsetPointAlongVector(projectPoint, offsetVector,offsetDis)
if inAngle > 45 and inAngle <90:
	angle = inAngle
	angRad = math.radians(angle)
	offsetDis = dis*tan(angRad)
	tmpPoint = offsetPointAlongVector(projectPoint, offsetVector,offsetDis)
if inAngle == 90:
	tmpPoint = projectPoint

TransactionManager.Instance.TransactionTaskDone()

OUT = [nf_firstPipeConns[0].ToPoint(), tmpPoint.ToPoint()], firstPipe, secondPipe, projectPoint.ToPoint(), nf_secondPipeConns[0]
# ----------------------------------------
code_block_3 = CodeBlock(points=nearfarconns_bp_mp, mPipe=nearfarconns_bp_mp, bPipe=nearfarconns_bp_mp, nearConnOfSecondPipe=nearfarconns_bp_mp) { points[0]; mPipe[1]; bPipe[2]; nearConnOfSecondPipe[3]; }
tmpPipe = Python(IN[0]=code_block_3.out0, IN[1]=code_block_3.out1, IN[2]=code_block_3.out3, IN[3]=code_block_3.out2)  # IronPython2
# ---------- tmpPipe.python (143 lines) ----------
"""Copyright by: vudinhduybm@gmail.com"""
#region ___import all Library
import clr
import sys 
import System   
import math
import collections

from math import *

clr.AddReference("ProtoGeometry")
from Autodesk.DesignScript.Geometry import *

clr.AddReference("RevitAPI") 
import Autodesk
from Autodesk.Revit.DB import* 
from Autodesk.Revit.DB.Structure import*


clr.AddReference("RevitAPIUI") 
from Autodesk.Revit.UI import*
from Autodesk.Revit.UI.Selection import ISelectionFilter

clr.AddReference("System") 
from System.Collections.Generic import List

clr.AddReference("RevitNodes")
import Revit
clr.ImportExtensions(Revit.Elements)
clr.ImportExtensions(Revit.GeometryConversion)

clr.AddReference("RevitServices")
import RevitServices
from RevitServices.Persistence import DocumentManager
from RevitServices.Transactions import TransactionManager

clr.AddReference("System.Windows.Forms")
clr.AddReference("System.Drawing")
clr.AddReference("System.Windows.Forms.DataVisualization")

import System.Windows.Forms 
from System.Windows.Forms import *
import System.Drawing
from System.Drawing import *
#endregion

#region ___Current doc/app/ui
doc = DocumentManager.Instance.CurrentDBDocument
uiapp = DocumentManager.Instance.CurrentUIApplication
app = uiapp.Application
uidoc = DocumentManager.Instance.CurrentUIApplication.ActiveUIDocument
view = doc.ActiveView
#endregion

#region ___someFunctions
def uwList(input):
    result = input if isinstance(input, list) else [input]
    return UnwrapElement(input)
def pipeCreateFromPoints(desPointsList, sel_pipingSystem, sel_PipeType, sel_Level, diameter):
    lst_Points1 = [i for i in desPointsList]
    lst_Points2 = [i for i in desPointsList[1:]]
    linesList = []
    for pt1, pt2 in zip(lst_Points1,lst_Points2):
        line =  Autodesk.DesignScript.Geometry.Line.ByStartPointEndPoint(pt1,pt2)
        linesList.append(line)
    firstPoint   = [x.StartPoint for x in linesList]
    secondPoint  = [x.EndPoint for x in linesList]
    pipesList = []
    pipesList1 = []
    TransactionManager.Instance.EnsureInTransaction(doc)
    for i,x in enumerate(firstPoint):
        try:
            levelId = sel_Level.Id
            sysTypeId = sel_pipingSystem.Id
            pipeTypeId = sel_PipeType.Id
            diam = diameter
            pipe = Autodesk.Revit.DB.Plumbing.Pipe.Create(doc,sysTypeId,pipeTypeId,levelId,x.ToXyz(),secondPoint[i].ToXyz())
            param_Diameter = pipe.get_Parameter(BuiltInParameter.RBS_PIPE_DIAMETER_PARAM)
            param_Diameter.SetValueString(diam.ToString())
            TransactionManager.Instance.EnsureInTransaction(doc)
            pipesList.append(pipe.ToDSType(False))
            pipesList1.append(pipe)
            # param_Length.Set()
            TransactionManager.Instance.TransactionTaskDone()
        except:
            pipesList.append(None)				
    TransactionManager.Instance.TransactionTaskDone()
    return pipesList
	
def getPipeParameter(p):
    paramDiameters = []
    paramPipingSystems = []
    paramLevels = []
    paramPipeTypes = []

    paramDiameter = p.get_Parameter(BuiltInParameter.RBS_PIPE_DIAMETER_PARAM).AsDouble() * 304.8
    
    paramPipeTypeId = p.GetTypeId()
    paramPipeType = doc.GetElement(paramPipeTypeId)
    paramPipeTypes.append(paramPipeType)
    pipeTypeName = paramPipeType.LookupParameter("Type Name").AsString()
	
    paramPipingSystemId = p.get_Parameter(BuiltInParameter.RBS_PIPING_SYSTEM_TYPE_PARAM).AsElementId()
    paramPipingSystem = doc.GetElement(paramPipingSystemId)
    paramPipingSystems.append(paramPipingSystem)
    pipingSystemName = paramPipingSystem.LookupParameter("System Classification").AsValueString()

    paramLevelId = p.get_Parameter(BuiltInParameter.RBS_START_LEVEL_PARAM).AsElementId()
    paramLevel = doc.GetElement(paramLevelId)
    paramLevels.append(paramLevel)

    return [paramDiameter, paramPipingSystem, paramPipeType, paramLevel],[paramDiameter,pipingSystemName,pipeTypeName,paramLevel]
    
def flatten(nestedList):
    flatList = []
    for item in nestedList:
        if isinstance(item, list):
            flatList.extend(flatten(item))
        else:
            flatList.append(item)
    return flatList
#endregion


pointList   = uwList(IN[0])
basePipe    = uwList(IN[1])
nearConnOfSecondPipe = UnwrapElement(IN[2])
bPipe = UnwrapElement(IN[3])
# Do some action in a Transaction
TransactionManager.Instance.EnsureInTransaction(doc)
basePipeParam = getPipeParameter(basePipe)
diamParam = basePipeParam[0][0]
pipingSystemParam = basePipeParam[0][1]
pipeTypeParam = basePipeParam[0][2]
levelParam = basePipeParam[0][3]
tempPipe = pipeCreateFromPoints(pointList, pipingSystemParam, pipeTypeParam, levelParam, diamParam)
if tempPipe:
	transVector = pointList[1].ToRevitType() - nearConnOfSecondPipe.ToRevitType()
	transform = Autodesk.Revit.DB.Transform.CreateTranslation(transVector)
	ElementTransformUtils.MoveElement(doc, bPipe.Id, transVector)
TransactionManager.Instance.TransactionTaskDone()

OUT = flatten(tempPipe)
# ----------------------------------------
list_create = List.Create(item0=code_block_3.out2, item1=tmpPipe, item2=code_block_3.out1)

# group: connect pipes by elbow
code_block_4 = CodeBlock(x=list_create) { List.Flatten(x); }
connect_tmpPipeAndBranchPipeByElbow = Python(IN[0]=code_block_4)  # IronPython2
# ---------- connect_tmpPipeAndBranchPipeByElbow.python (102 lines) ----------
"""Copyright by: vudinhduybm@gmail.com"""
#region ___import all Library
import clr
import sys 
import System   
import math
import collections

from math import *

clr.AddReference("ProtoGeometry")
from Autodesk.DesignScript.Geometry import *

clr.AddReference("RevitAPI") 
import Autodesk
from Autodesk.Revit.DB import* 
from Autodesk.Revit.DB.Structure import*

clr.AddReference("RevitAPIUI") 
from Autodesk.Revit.UI import*
from Autodesk.Revit.UI.Selection import ISelectionFilter

clr.AddReference("System") 
from System.Collections.Generic import List

clr.AddReference("RevitNodes")
import Revit
clr.ImportExtensions(Revit.Elements)
clr.ImportExtensions(Revit.GeometryConversion)

clr.AddReference("RevitServices")
import RevitServices
from RevitServices.Persistence import DocumentManager
from RevitServices.Transactions import TransactionManager

clr.AddReference("System.Windows.Forms")
clr.AddReference("System.Drawing")
clr.AddReference("System.Windows.Forms.DataVisualization")

import System.Windows.Forms 
from System.Windows.Forms import *
import System.Drawing
from System.Drawing import *
#endregion

#region ___Current doc/app/ui
doc = DocumentManager.Instance.CurrentDBDocument
uiapp = DocumentManager.Instance.CurrentUIApplication
app = uiapp.Application
uidoc = DocumentManager.Instance.CurrentUIApplication.ActiveUIDocument
view = doc.ActiveView
#endregion

#region ___someFunctions
def uwList(input):
    result = input if isinstance(input, list) else [input]
    return UnwrapElement(input)
def createElbow(doc, pipes):
	connectors = []
	elbowList = []
	try:
		for pipe in pipes:
			connectors.append(pipe.ConnectorManager.Connectors)
	except:
		pass

	TransactionManager.Instance.EnsureInTransaction(doc)
	
	try:
		for set1, set2 in zip(connectors[:-1], connectors[1:]):
			conStart = list(set1)
			conEnd = list(set2)
			d1 = conStart[0].Origin.DistanceTo(conEnd[0].Origin)*conStart[0].Origin.DistanceTo(conEnd[1].Origin)
			d2 = conStart[1].Origin.DistanceTo(conEnd[0].Origin)*conStart[1].Origin.DistanceTo(conEnd[1].Origin)
			i = 0
			if d1 > d2:
				i = 1
	
			d3 = conEnd[0].Origin.DistanceTo(conStart[0].Origin)*conEnd[0].Origin.DistanceTo(conStart[1].Origin)
			d4 = conEnd[1].Origin.DistanceTo(conStart[0].Origin)*conEnd[1].Origin.DistanceTo(conStart[1].Origin)
			j = 0
			if d3 > d4:
				j = 1
	
			fitting = doc.Create.NewElbowFitting(conStart[i],conEnd[j])
			elbowList.append(fitting)
	except:
		pass

	return elbowList
#endregion


pipeList   = uwList(IN[0])

# Do some action in a Transaction
TransactionManager.Instance.EnsureInTransaction(doc)
elbow = createElbow(doc, pipeList)

TransactionManager.Instance.TransactionTaskDone()

OUT = elbow
# ----------------------------------------

boolean_2 = BoolSelector(true)
python_script = Python(IN[0]=boolean_2)  # IronPython2
# ---------- python_script.python (456 lines) ----------
"""Copyright by: vudinhduybm@gmail.com"""
#region ___import all Library
import clr
import sys 
import System   
import math
import collections

from math import sin,cos, tan
clr.AddReference("ProtoGeometry")

from Autodesk.DesignScript.Geometry import *

clr.AddReference("RevitAPI") 
import Autodesk
from Autodesk.Revit.DB import* 
from Autodesk.Revit.DB.Structure import*
from Autodesk.Revit.DB import Line, XYZ, IntersectionResultArray, SetComparisonResult

clr.AddReference("RevitAPIUI") 
from Autodesk.Revit.UI.Selection import ISelectionFilter
from Autodesk.Revit.UI import*

clr.AddReference("System") 
from System.Collections.Generic import List

clr.AddReference("RevitNodes")
import Revit
clr.ImportExtensions(Revit.Elements)
clr.ImportExtensions(Revit.GeometryConversion)

clr.AddReference("RevitServices")
import RevitServices
from RevitServices.Persistence import DocumentManager
from RevitServices.Transactions import TransactionManager

clr.AddReference("System.Windows.Forms")
clr.AddReference("System.Drawing")
clr.AddReference("System.Windows.Forms.DataVisualization")

import System.Windows.Forms 
from System.Windows.Forms import *
import System.Drawing
from System.Drawing import *
#endregion

#region ___Current doc/app/ui
doc = DocumentManager.Instance.CurrentDBDocument
uiapp = DocumentManager.Instance.CurrentUIApplication
app = uiapp.Application
uidoc = DocumentManager.Instance.CurrentUIApplication.ActiveUIDocument
view = doc.ActiveView
#endregion

#region ___someFunctions
def uwList(input):
    result = input if isinstance(input, list) else [input]
    return UnwrapElement(input)
def flatten(nestedList):
    flatList = []
    for item in nestedList:
        if isinstance(item, list):
            flatList.extend(flatten(item))
        else:
            flatList.append(item)
    return flatList    
def projectPointToCurve(mPipe, bPipe):
    mPCurve = mPipe.Location.Curve
    nearestConOfBPipe =  closetConn(mPipe, bPipe)
    pMid = mPCurve.Project(nearestConOfBPipe).XYZPoint.ToPoint()
    return pMid
def NearestConnector(ConnectorSet, curCurve):
    MinLength = float("inf")
    result = None 
    for n in ConnectorSet:
        distance = curCurve.Location.Curve.Distance(n.Origin)
        if distance < MinLength:
            MinLength = distance
            result = n
    return result
def closetConn(mPipe, bPipe):
    connectors1 = list(bPipe.ConnectorManager.Connectors.GetEnumerator())
    Connector1 = NearestConnector(connectors1, mPipe)
    XYZconn	= Connector1.Origin
    return XYZconn
def pullPointToOxy(XYZpoint):
	newPoint = XYZ(XYZpoint.X, XYZpoint.Y, 0)
	return newPoint
def pullPipeToOxy(pipe):
	pCurve = pipe.Location.Curve
	startPoint = pCurve.GetEndPoint(0)
	endPoint = pCurve.GetEndPoint(1)
	oxySP = pullPointToOxy(startPoint)
	oxyEP = pullPointToOxy(endPoint)
	oxyCurve = Line.CreateBound(oxySP, oxyEP)
	return oxyCurve
def sortNFConn_bPipe(mPipe, bPipe):
    sortConnList = []
    originConns  = []
    tmp = []
    tmp1 = []
    tmp2 = []
    connList = list(bPipe.ConnectorManager.Connectors.GetEnumerator())
    nearConn = NearestConnector(connList, mPipe)
    tmp1.append(nearConn)
    farConn =  [c for c in connList  if c not in tmp1]
    tmp1.append([c for c in connList if c != nearConn])
    sortConnList = flatten(tmp1)
    tmp2.append([c.Origin for c in sortConnList])
    originConns = flatten(tmp2)
    #XYZconn	= nearConn.Origin
    return originConns	
def offsetPointAlongVector(point, vector, offsetDistance):
    direction = vector.Normalize()
    scaledVector = direction.Multiply(offsetDistance)
    offsetPoint = point.Add(scaledVector)
    return offsetPoint
def findIntersection(line1, line2):
    # Prepare the intersection result array
    intersectionResultArray = clr.Reference[Autodesk.Revit.DB.IntersectionResultArray]()
    # Find the intersection of the two lines
    result = line1.Intersect(line2, intersectionResultArray)
    # Check if the result is an overlap
    if result == SetComparisonResult.Overlap and intersectionResultArray.Size > 0:
        intersectionPoint = intersectionResultArray.get_Item(0).XYZPoint
        return intersectionPoint
    else:
        return None
def createPlaneContainingLine(line):
    startPoint = line.GetEndPoint(0)
    direction = line.Direction
    normal = direction.CrossProduct(XYZ.BasisZ)  
    plane = Plane.CreateByNormalAndOrigin(normal, startPoint)
    return plane
def find_intersection(line, plane):
    plane_normal = plane.Normal
    plane_origin = plane.Origin
    line_direction = line.Direction
    line_point = line.GetEndPoint(0)
    # Vector from the plane origin to the line point
    origin_to_point = line_point - plane_origin
    # Dot product of the plane normal and the line direction
    dot_product = plane_normal.DotProduct(line_direction)
    # Check if the line is parallel to the plane
    if abs(dot_product) < 1e-9:
        # The line is parallel to the plane, no intersection
        return None
    # Calculate the parameter t for the line equation
    t = plane_normal.DotProduct(plane_origin - line_point) / dot_product
    # Calculate the intersection point
    intersection_point = line_point + t * line_direction
    return intersection_point
def calculateDistance(pointA, pointB):
    dx = pointA.X - pointB.X
    dy = pointA.Y - pointB.Y
    dz = pointA.Z - pointB.Z
    distance = math.sqrt(dx**2 + dy**2 + dz**2)
    return distance
def pipeCreateFromPoints(desPointsList, sel_pipingSystem, sel_PipeType, sel_Level, diameter):
    lst_Points1 = [i for i in desPointsList]
    lst_Points2 = [i for i in desPointsList[1:]]
    linesList = []
    for pt1, pt2 in zip(lst_Points1,lst_Points2):
        line =  Autodesk.DesignScript.Geometry.Line.ByStartPointEndPoint(pt1,pt2)
        linesList.append(line)
    firstPoint   = [x.StartPoint for x in linesList]
    secondPoint  = [x.EndPoint for x in linesList]
    TransactionManager.Instance.EnsureInTransaction(doc)
    for i,x in enumerate(firstPoint):
        try:
            levelId = sel_Level.Id
            sysTypeId = sel_pipingSystem.Id
            pipeTypeId = sel_PipeType.Id
            diam = diameter
            pipe = Autodesk.Revit.DB.Plumbing.Pipe.Create(doc,sysTypeId,pipeTypeId,levelId,x.ToXyz(),secondPoint[i].ToXyz())
            param_Diameter = pipe.get_Parameter(BuiltInParameter.RBS_PIPE_DIAMETER_PARAM)
            param_Diameter.SetValueString(diam.ToString())
            TransactionManager.Instance.EnsureInTransaction(doc)

            # param_Length.Set()
            TransactionManager.Instance.TransactionTaskDone()
        except: pass			
    TransactionManager.Instance.TransactionTaskDone()
    return pipe
def getPipeParameter(p):
    paramDiameter = p.get_Parameter(BuiltInParameter.RBS_PIPE_DIAMETER_PARAM).AsDouble() * 304.8
    
    paramPipeTypeId = p.GetTypeId()
    paramPipeType = doc.GetElement(paramPipeTypeId)
    pipeTypeName = paramPipeType.LookupParameter("Type Name").AsString()
	
    paramPipingSystemId = p.get_Parameter(BuiltInParameter.RBS_PIPING_SYSTEM_TYPE_PARAM).AsElementId()
    paramPipingSystem = doc.GetElement(paramPipingSystemId)
    pipingSystemName = paramPipingSystem.LookupParameter("System Classification").AsValueString()

    paramLevelId = p.get_Parameter(BuiltInParameter.RBS_START_LEVEL_PARAM).AsElementId()
    paramLevel = doc.GetElement(paramLevelId)

    return paramPipingSystem, paramPipeType, paramLevel, paramDiameter
def flatten(nestedList):
    flatList = []
    for item in nestedList:
        if isinstance(item, list):
            flatList.extend(flatten(item))
        else:
            flatList.append(item)
    return flatList
def createElbow(doc, pipes):
    elbowList = []
    bestConns = []
    if not pipes or len(pipes) < 2:
        return elbowList
    TransactionManager.Instance.EnsureInTransaction(doc)
    try:
        # Duyệt qua các cặp pipe liên tiếp
        for pipe1, pipe2 in zip(pipes[:-1], pipes[1:]):
            try:
                # Lấy ConnectorManager của hai pipe
                conn_manager1 = pipe1.ConnectorManager
                conn_manager2 = pipe2.ConnectorManager                
                if not conn_manager1 or not conn_manager2:
                    continue                
                # Lấy tất cả connector
                connectors1 = list(conn_manager1.Connectors)
                connectors2 = list(conn_manager2.Connectors)               
                if len(connectors1) < 1 or len(connectors2) < 1:
                    continue               
                # Tìm cặp connector gần nhất
                min_distance = float('inf')
                best_conn1 = None
                best_conn2 = None               
                for conn1 in connectors1:
                    for conn2 in connectors2:
                        distance = conn1.Origin.DistanceTo(conn2.Origin)
                        if distance < min_distance:
                            min_distance = distance
                            best_conn1 = conn1
                            best_conn2 = conn2
                            bestConns.append(best_conn1)
                            bestConns.append(best_conn2)

                if best_conn1 is None or best_conn2 is None:
                    continue
                # Kiểm tra khoảng cách hợp lệ (ví dụ: dưới 1 feet)
                if min_distance > 1.0:  # Đơn vị feet
                    continue
                # bestConns.append(best_conn1, best_conn2)
                fitting = doc.Create.NewElbowFitting(best_conn1, best_conn2)
                elbowList.append(fitting)               
            except Exception as e:
                continue
    except Exception as e: pass
    return bestConns

class selectionFilter(ISelectionFilter):
    def __init__(self, category):
          self.category = category
    def AllowElement(self, element):
        if element.Category.Name == self.category:
            return True
        else:
            return False
def pickPipe():
    pipeFilter = selectionFilter('Pipes')
    pipeRef = uidoc.Selection.PickObject(Autodesk.Revit.UI.Selection.ObjectType.Element, pipeFilter)
    pipe = doc.GetElement(pipeRef.ElementId)
    return pipe
def find_closest_connector(mainPipe, branchPipe):
    """
    Tìm connector gần nhất của ống nhánh đến đường cong của ống chính.
    
    Args:
        mainPipe: Pipe chính (Pipe object)
        branchPipe: Pipe nhánh (Pipe object)
    
    Returns:
        Tuple (Connector, XYZ): Connector gần nhất và tọa độ của nó, hoặc (None, None) nếu lỗi.
    """   
    try:
        # Lấy đường cong của ống chính
        main_curve = mainPipe.Location.Curve
        if not main_curve:
            return None, None
        # Lấy connectors của ống nhánh
        branch_connectors = list(branchPipe.ConnectorManager.Connectors)
        if not branch_connectors:
            return None, None        
        # Tìm connector gần nhất
        min_distance = float("inf")
        closest_conn = None
        closest_xyz = None
        for conn in branch_connectors:
            if not hasattr(conn, "Origin"):
                continue
            # Chiếu điểm connector lên đường cong ống chính
            projection = main_curve.Project(conn.Origin)
            if projection is None:
                continue
            distance = conn.Origin.DistanceTo(projection.XYZPoint)
            if distance < min_distance:
                min_distance = distance
                closest_conn = conn
                closest_xyz = conn.Origin       
        if closest_conn is None:
            return None, None
        sorted_connectors = [closest_conn]
        for conn in branch_connectors:
            if conn != closest_conn:
                sorted_connectors.append(conn)
                break
        return closest_conn, closest_xyz, sorted_connectors
    except Exception as e:
        return None, None
#endregion

#region input Value
mPipe   = pickPipe()
bPipe	= pickPipe()
#endregion

#region input Angle
class MyForm(Form):
    def __init__(self):
        #NOTE: Để tạo UI có kích thước tương đối so với màn hình làm việc
            #  Ta dùng Screen.PrimaryScreen.WorkingArea
        primary_screen = Screen.PrimaryScreen.WorkingArea
        screen_width = primary_screen.Width // 5
        screen_height = primary_screen.Height // 6
        self.Text = ''
        self.ClientSize = Size(screen_width, screen_height)
        self.Font = System.Drawing.Font("Meiryo UI", 7.5, System.Drawing.FontStyle.Bold, System.Drawing.GraphicsUnit.Point, 128)
        self.ForeColor = System.Drawing.Color.Red     
        # Create and add label
        self.label = Label()
        self.label.Text = "ANGLE"
        self.label.Size = Size(screen_width // 2, 50)
        self.label.Location = Point(20, 20)
        self.Controls.Add(self.label)
        # Create and add text box
        self.textBox = TextBox()
        self.textBox.Location = Point(30, 70)
        self.textBox.Size = Size(screen_width // 1.1, 200)
        self.textBox.KeyDown += self.textBox_KeyDown
        self.Controls.Add(self.textBox)
        
        # Create and add OK button
        self.okButton = Button()
        self.okButton.Text = 'OK'
        self.okButton.Size = Size(150,40)
        self.okButton.Location = Point(screen_width - 350, 
                                       screen_height - 70)
        self.okButton.Click += self.okButton_Click
        self.Controls.Add(self.okButton)
        # Create and add Cancel button
        self.cancelButton = Button()
        self.cancelButton.Text = 'CANCLE'
        self.cancelButton.Size = Size(150,40)
        self.cancelButton.Location = Point(screen_width - 180, 
                                           screen_height - 70)
        self.cancelButton.Click += self.cancelButton_Click
        self.Controls.Add(self.cancelButton)
        self.fvcLabel = Label()
        self.fvcLabel.Text = "@FVC"
        self.fvcLabel.Size = Size(150, 40)
        self.fvcLabel.Location = Point(20, screen_height - 50)  # Bottom left corner
        self.Controls.Add(self.fvcLabel)        
        # self.FormBorderStyle = System.Windows.Forms.FormBorderStyle.Fixed3D
        self.result = None
        ###
    def textBox_KeyDown(self, sender, event):
            if event.KeyCode == Keys.Enter:
                self.okButton_Click(sender, None)  # Gọi cùng logic của OK
                event.Handled = True        
    def okButton_Click(self, sender, event):
        self.result = self.textBox.Text
        self.DialogResult = DialogResult.OK
        self.Close()
    def cancelButton_Click(self, sender, event):
        self.DialogResult = DialogResult.Cancel
        self.Close()
form = MyForm()
result = form.ShowDialog()
# Output the result if OK was clicked
if result == DialogResult.OK:
    text_input = form.result
else:
    text_input = None
###
returnAngle = float(text_input)
##
inAngle = returnAngle
#endregion
# Do some action in a Transaction
#NOTE: Tại đây ta lấy về XYZ của 2 connector gần nhất của ống nhánh và ống chính
mPipeCurve = mPipe.Location.Curve
bPipeCurve = bPipe.Location.Curve
bestConn_bPipe = find_closest_connector(mPipe, bPipe)[1]
bestConn_mPipe = find_closest_connector(bPipe, mPipe)[1]
#NOTE: Lấy về sorted list conns của mPipe và bPipe
sortedConns_mPipe = find_closest_connector(bPipe, mPipe)[2]
sortedConns_bPipe = find_closest_connector(mPipe, bPipe)[2]

#NOTE: Scale bPipeCurve để đảm bảo luôn chiếu được bestConn của mPipe lên bPipe
tempPoint_bPipe_offsetVector = sortedConns_bPipe[0].Origin - sortedConns_bPipe[1].Origin
tempPoint_bPipe = offsetPointAlongVector(sortedConns_bPipe[0].Origin, 
                                         tempPoint_bPipe_offsetVector,
                                         bPipeCurve.Length)
tempLine = Line.CreateBound(tempPoint_bPipe, sortedConns_bPipe[1].Origin)
projectPoint = tempLine.Project(bestConn_mPipe).XYZPoint
#NOTE: Tìm điểm chiếu trên bPipe thỏa điều kiện góc nhập vào 
#Khoảng cách từ điểm gióng đến best connector main pipe
dis = calculateDistance(projectPoint, bestConn_mPipe) 
offsetVector = sortedConns_bPipe[0].Origin - projectPoint
if inAngle <= 45:
	angle = 90 - inAngle
	angRad = math.radians(angle)
	offsetDis = dis*tan(angRad)
	tmpPoint = offsetPointAlongVector(projectPoint, offsetVector,offsetDis)
if inAngle > 45 and inAngle <90:
	angle = inAngle
	angRad = math.radians(angle)
	offsetDis = dis*tan(angRad)
	tmpPoint = offsetPointAlongVector(projectPoint, offsetVector,offsetDis)
if inAngle == 90:
	tmpPoint = projectPoint

#NOTE: Tại bước trên ta đã tìm được điểm gióng từ nearConn of main pipe lên
#      trên ống branch pipe ứng với góc input do người nhập
#      Ta đi tạo ống temp ở giữa

TransactionManager.Instance.EnsureInTransaction(doc)
tempPipePoints = [bestConn_mPipe.ToPoint(), tmpPoint.ToPoint()]
mPipeParam = getPipeParameter(mPipe)
tempPipe = pipeCreateFromPoints(tempPipePoints, mPipeParam[0],
                                                mPipeParam[1],
                                                mPipeParam[2],
                                                mPipeParam[3])
TransactionManager.Instance.TransactionTaskDone()
#NOTE: Tạo new bPipe
newListPipe = [mPipe,tempPipe]
TransactionManager.Instance.EnsureInTransaction(doc)
farConn_bPipe = sortedConns_bPipe[1].Origin.ToPoint()
new_bPipe_Points = [farConn_bPipe, tmpPoint.ToPoint()]
new_bPipe = pipeCreateFromPoints(new_bPipe_Points,
                                 mPipeParam[0],
                                 mPipeParam[1],
                                 mPipeParam[2],
                                 mPipeParam[3])
newListPipe.append(new_bPipe)
doc.Delete(bPipe.Id)
TransactionManager.Instance.TransactionTaskDone()
#NOTE: Connect pipes by elbows
TransactionManager.Instance.EnsureInTransaction(doc)
elbows = createElbow(doc, newListPipe)
TransactionManager.Instance.TransactionTaskDone()
OUT =  'Hello World'
# ----------------------------------------
