# Dynamo graph connect 2 Per Pipe v2_script.dyn "connect 2 Per Pipe_script" (Dynamo 2.10.1.3976)

# group: pick main Pipe and branch Pipe
boolean = BoolSelector(true)
mainPipe = Python(IN[0]=boolean)  # IronPython2
# ---------- mainPipe.python (67 lines) ----------
"""Copyright by: vudinhduybm@gmail.com"""
#region ___import all Library
import clr
import sys 
import System   
import math
import collections

clr.AddReference("ProtoGeometry")

from Autodesk.DesignScript.Geometry import *

clr.AddReference("RevitAPI") 
import Autodesk
from Autodesk.Revit.DB import* 
from Autodesk.Revit.DB.Structure import*

clr.AddReference("RevitAPIUI") 
from Autodesk.Revit.UI import*

clr.AddReference("System") 
from System.Collections.Generic import List

clr.AddReference("RevitNodes")
import Revit
clr.ImportExtensions(Revit.Elements)
clr.ImportExtensions(Revit.GeometryConversion)

clr.AddReference("RevitServices")
import RevitServices
from RevitServices.Persistence import DocumentManager
from RevitServices.Transactions import TransactionManager
from Autodesk.Revit.UI.Selection import ObjectType

clr.AddReference("System.Windows.Forms")
clr.AddReference("System.Drawing")
clr.AddReference("System.Windows.Forms.DataVisualization")

import System.Windows.Forms 
from System.Windows.Forms import *
import System.Drawing
from System.Drawing import *
#endregion

#region ___Current doc/app/ui
doc = DocumentManager.Instance.CurrentDBDocument
uiapp = DocumentManager.Instance.CurrentUIApplication
app = uiapp.Application
uidoc = DocumentManager.Instance.CurrentUIApplication.ActiveUIDocument
view = doc.ActiveView
#endregion

#region ___someFunctions
def uwList(input):
    result = input if isinstance(input, list) else [input]
    return UnwrapElement(input)
def pickObject():
    ref = uidoc.Selection.PickObject(ObjectType.Element)
    ele = doc.GetElement(ref.ElementId)
    return  ele
#endregion
TransactionManager.Instance.EnsureInTransaction(doc)


TransactionManager.Instance.TransactionTaskDone()

OUT = pickObject()
# ----------------------------------------
code_block = CodeBlock(data=boolean, waitfor=mainPipe) { [data, waitfor]; }
branchPipe = Python(IN[0]=code_block)  # IronPython2; same code as mainPipe

# group: user input angle
code_block_2 = CodeBlock(data=boolean, waitfor=branchPipe) { [data, waitfor]; }
userInputAngle = Python(IN[0]=code_block_2)  # IronPython2
# ---------- userInputAngle.python (74 lines) ----------
import clr
import System
clr.AddReference('System.Windows.Forms')
clr.AddReference('System.Drawing')
from System.Windows.Forms import Form, Label, TextBox, Button, DialogResult, PaintEventHandler
from System.Drawing import Point, Size, Font, FontStyle, GraphicsUnit, Color, Brush, Brushes


# Create a form
class MyForm(Form):
    def __init__(self):
        self.Text = ''
        self.Size = Size(300, 180)
        self.Font = System.Drawing.Font("Meiryo UI", 7.5, System.Drawing.FontStyle.Bold, System.Drawing.GraphicsUnit.Point, 128)
        self.ForeColor = System.Drawing.Color.Red

      
        # Create and add label
        self.label = Label()
        self.label.Text = "Angle"
        self.label.Size = Size(260,20)
        self.label.Location = Point(10, 10)
        self.Controls.Add(self.label)
        
        # Create and add text box
        self.textBox = TextBox()
        self.textBox.Location = Point(10, 40)
        self.textBox.Size = Size(260, 20)
        self.Controls.Add(self.textBox)
        
        # Create and add OK button
        self.okButton = Button()
        self.okButton.Text = 'OK'
        self.okButton.Location = Point(120, 90)
        self.okButton.Click += self.okButton_Click
        self.Controls.Add(self.okButton)
        
        # Create and add Cancel button
        self.cancelButton = Button()
        self.cancelButton.Text = 'Cancel'
        self.cancelButton.Location = Point(200, 90)
        self.cancelButton.Click += self.cancelButton_Click
        self.Controls.Add(self.cancelButton)
        
        self.fvcLabel = Label()
        self.fvcLabel.Text = "@FVC"
        self.fvcLabel.Size = Size(50, 20)
        self.fvcLabel.Location = Point(10, 110)  # Bottom left corner
        self.Controls.Add(self.fvcLabel)        

        self.FormBorderStyle = System.Windows.Forms.FormBorderStyle.Fixed3D
        self.result = None

    def okButton_Click(self, sender, event):
        self.result = self.textBox.Text
        self.DialogResult = DialogResult.OK
        self.Close()

    def cancelButton_Click(self, sender, event):
        self.DialogResult = DialogResult.Cancel
        self.Close()

# Show the form and get the result
form = MyForm()
result = form.ShowDialog()

# Output the result if OK was clicked
if result == DialogResult.OK:
    text_input = form.result
else:
    text_input = None

# Assign the result to Dynamo output
OUT = float(text_input)
# ----------------------------------------

# group: create temp Pipe
getPullPointFromBranchPipeToMainPipe = Python(IN[0]=mainPipe, IN[1]=branchPipe, IN[2]=userInputAngle)  # IronPython2
# ---------- getPullPointFromBranchPipeToMainPipe.python (200 lines) ----------
"""Copyright by: vudinhduybm@gmail.com"""
#region ___import all Library
import clr
import sys 
import System   
import math
import collections

clr.AddReference("ProtoGeometry")

from Autodesk.DesignScript.Geometry import *

clr.AddReference("RevitAPI") 
import Autodesk
from Autodesk.Revit.DB import* 
from Autodesk.Revit.DB.Structure import*
from Autodesk.Revit.DB import Line, XYZ, IntersectionResultArray, SetComparisonResult

clr.AddReference("RevitAPIUI") 
from Autodesk.Revit.UI import*

clr.AddReference("System") 
from System.Collections.Generic import List

clr.AddReference("RevitNodes")
import Revit
clr.ImportExtensions(Revit.Elements)
clr.ImportExtensions(Revit.GeometryConversion)

clr.AddReference("RevitServices")
import RevitServices
from RevitServices.Persistence import DocumentManager
from RevitServices.Transactions import TransactionManager

clr.AddReference("System.Windows.Forms")
clr.AddReference("System.Drawing")
clr.AddReference("System.Windows.Forms.DataVisualization")

import System.Windows.Forms 
from System.Windows.Forms import *
import System.Drawing
from System.Drawing import *
#endregion

#region ___Current doc/app/ui
doc = DocumentManager.Instance.CurrentDBDocument
uiapp = DocumentManager.Instance.CurrentUIApplication
app = uiapp.Application
uidoc = DocumentManager.Instance.CurrentUIApplication.ActiveUIDocument
view = doc.ActiveView
#endregion

#region ___someFunctions
def uwList(input):
    result = input if isinstance(input, list) else [input]
    return UnwrapElement(input)
def flatten(nestedList):
    flatList = []
    for item in nestedList:
        if isinstance(item, list):
            flatList.extend(flatten(item))
        else:
            flatList.append(item)
    return flatList    
def projectPointToCurve(mPipe, bPipe):
    mPCurve = mPipe.Location.Curve
    nearestConOfBPipe =  closetConn(mPipe, bPipe)
    pMid = mPCurve.Project(nearestConOfBPipe).XYZPoint.ToPoint()
    return pMid

def NearestConnector(ConnectorSet, curCurve):
    MinLength = float("inf")
    result = None 
    for n in ConnectorSet:
        distance = curCurve.Location.Curve.Distance(n.Origin)
        if distance < MinLength:
            MinLength = distance
            result = n
    return result

def closetConn(mPipe, bPipe):
    connectors1 = list(bPipe.ConnectorManager.Connectors.GetEnumerator())
    Connector1 = NearestConnector(connectors1, mPipe)
    XYZconn	= Connector1.Origin
    return XYZconn
def pullPointToOxy(XYZpoint):
	newPoint = XYZ(XYZpoint.X, XYZpoint.Y, 0)
	return newPoint
def pullPipeToOxy(pipe):
	pCurve = pipe.Location.Curve
	startPoint = pCurve.GetEndPoint(0)
	endPoint = pCurve.GetEndPoint(1)
	oxySP = pullPointToOxy(startPoint)
	oxyEP = pullPointToOxy(endPoint)
	oxyCurve = Line.CreateBound(oxySP, oxyEP)
	return oxyCurve
def sortNFConn_bPipe(mPipe, bPipe):
    sortConnList = []
    originConns  = []
    tmp = []
    tmp1 = []
    tmp2 = []
    connList = list(bPipe.ConnectorManager.Connectors.GetEnumerator())
    nearConn = NearestConnector(connList, mPipe)
    tmp1.append(nearConn)
    farConn =  [c for c in connList  if c not in tmp1]
    tmp1.append([c for c in connList if c != nearConn])
    sortConnList = flatten(tmp1)
    tmp2.append([c.Origin for c in sortConnList])
    originConns = flatten(tmp2)
    #XYZconn	= nearConn.Origin
    return originConns	
def offsetPointAlongVector(point, vector, offsetDistance):
    direction = vector.Normalize()
    scaledVector = direction.Multiply(offsetDistance)
    offsetPoint = point.Add(scaledVector)
    return offsetPoint
def findIntersection(line1, line2):
    # Prepare the intersection result array
    intersectionResultArray = clr.Reference[Autodesk.Revit.DB.IntersectionResultArray]()
    # Find the intersection of the two lines
    result = line1.Intersect(line2, intersectionResultArray)
    # Check if the result is an overlap
    if result == SetComparisonResult.Overlap and intersectionResultArray.Size > 0:
        intersectionPoint = intersectionResultArray.get_Item(0).XYZPoint
        return intersectionPoint
    else:
        return None
def createPlaneContainingLine(line):
    startPoint = line.GetEndPoint(0)
    direction = line.Direction
    normal = direction.CrossProduct(XYZ.BasisZ)  
    plane = Plane.CreateByNormalAndOrigin(normal, startPoint)
    return plane

def find_intersection(line, plane):
    plane_normal = plane.Normal
    plane_origin = plane.Origin
    line_direction = line.Direction
    line_point = line.GetEndPoint(0)
    # Vector from the plane origin to the line point
    origin_to_point = line_point - plane_origin
    # Dot product of the plane normal and the line direction
    dot_product = plane_normal.DotProduct(line_direction)
    # Check if the line is parallel to the plane
    if abs(dot_product) < 1e-9:
        # The line is parallel to the plane, no intersection
        return None
    # Calculate the parameter t for the line equation
    t = plane_normal.DotProduct(plane_origin - line_point) / dot_product
    # Calculate the intersection point
    intersection_point = line_point + t * line_direction
    return intersection_point
def calculateDistance(pointA, pointB):
    dx = pointA.X - pointB.X
    dy = pointA.Y - pointB.Y
    dz = pointA.Z - pointB.Z
    distance = math.sqrt(dx**2 + dy**2 + dz**2)
    return distance
#endregion
mPipe   = uwList(IN[0])
bPipe	= uwList(IN[1])
inAngle 	= UnwrapElement(IN[2])
# Do some action in a Transaction
TransactionManager.Instance.EnsureInTransaction(doc)
#pjPoint = projectPointToCurve(mPipe,bPipe)
nearConnOfBP = closetConn(mPipe,bPipe)
sortNearConnsBP = sortNFConn_bPipe(mPipe,bPipe)

mPipeCurve = mPipe.Location.Curve
bPipeCurve = bPipe.Location.Curve
bPipeCurve_SP = bPipeCurve.GetEndPoint(0)
bPipeCurve_EP = bPipeCurve.GetEndPoint(1)
offsetVector = sortNearConnsBP[0]-sortNearConnsBP[1]
newNearConn = offsetPointAlongVector(sortNearConnsBP[0] , offsetVector, 100)
#create a plane contain main pipe curve and scaled branch pipe curve
tmpLine = Line.CreateBound(newNearConn ,sortNearConnsBP[0])
tmpPlane = createPlaneContainingLine(mPipeCurve)
#get intersection point that On the tmpLine
intersectPoint = find_intersection(tmpLine, tmpPlane)
#create a plane contain tmpLine 
tmpPlane1 = createPlaneContainingLine(tmpLine)
#get intersection point that On the main pipe curve
intersectPoint1 = find_intersection(mPipeCurve, tmpPlane1)
#calculte distance of 2 intersection Point
dis = calculateDistance(intersectPoint, intersectPoint1)
#offset intersectPoint along branch pipe with the user input Angle
tmpPoint1 = intersectPoint
offsetVector1 = nearConnOfBP - tmpPoint1
#calculate offset distance
if inAngle <= 45:
	angle = 90 - inAngle
else:
	angle = inAngle
angRad = math.radians(angle)
tmpDis = dis*math.tan(angRad)
tmpPoint2 = offsetPointAlongVector(intersectPoint, offsetVector1, tmpDis)
TransactionManager.Instance.TransactionTaskDone()

OUT = intersectPoint1.ToPoint(), tmpPoint2.ToPoint(),nearConnOfBP.ToPoint(), mPipe, bPipe
# ----------------------------------------
code_block_3 = CodeBlock(tmpPoint1=getPullPointFromBranchPipeToMainPipe, tmpPoint2=getPullPointFromBranchPipeToMainPipe, nearConnOfBP=getPullPointFromBranchPipeToMainPipe, mPipe=getPullPointFromBranchPipeToMainPipe, bPipe=getPullPointFromBranchPipeToMainPipe) { tmpPoint1[0]; tmpPoint2[1]; nearConnOfBP[2]; mPipe[3]; bPipe[4]; }
list_create = List.Create(item0=code_block_3.out0, item1=code_block_3.out1)
tmpPipe = Python(IN[0]=list_create, IN[1]=code_block_3.out3)  # IronPython2
# ---------- tmpPipe.python (137 lines) ----------
"""Copyright by: vudinhduybm@gmail.com"""
#region ___import all Library
import clr
import sys 
import System   
import math
import collections

from math import *

clr.AddReference("ProtoGeometry")
from Autodesk.DesignScript.Geometry import *

clr.AddReference("RevitAPI") 
import Autodesk
from Autodesk.Revit.DB import* 
from Autodesk.Revit.DB.Structure import*

clr.AddReference("RevitAPIUI") 
from Autodesk.Revit.UI import*
from Autodesk.Revit.UI.Selection import ISelectionFilter

clr.AddReference("System") 
from System.Collections.Generic import List

clr.AddReference("RevitNodes")
import Revit
clr.ImportExtensions(Revit.Elements)
clr.ImportExtensions(Revit.GeometryConversion)

clr.AddReference("RevitServices")
import RevitServices
from RevitServices.Persistence import DocumentManager
from RevitServices.Transactions import TransactionManager

clr.AddReference("System.Windows.Forms")
clr.AddReference("System.Drawing")
clr.AddReference("System.Windows.Forms.DataVisualization")

import System.Windows.Forms 
from System.Windows.Forms import *
import System.Drawing
from System.Drawing import *
#endregion

#region ___Current doc/app/ui
doc = DocumentManager.Instance.CurrentDBDocument
uiapp = DocumentManager.Instance.CurrentUIApplication
app = uiapp.Application
uidoc = DocumentManager.Instance.CurrentUIApplication.ActiveUIDocument
view = doc.ActiveView
#endregion

#region ___someFunctions
def uwList(input):
    result = input if isinstance(input, list) else [input]
    return UnwrapElement(input)
def pipeCreateFromPoints(desPointsList, sel_pipingSystem, sel_PipeType, sel_Level, diameter):
    lst_Points1 = [i for i in desPointsList]
    lst_Points2 = [i for i in desPointsList[1:]]
    linesList = []
    for pt1, pt2 in zip(lst_Points1,lst_Points2):
        line =  Autodesk.DesignScript.Geometry.Line.ByStartPointEndPoint(pt1,pt2)
        linesList.append(line)
    firstPoint   = [x.StartPoint for x in linesList]
    secondPoint  = [x.EndPoint for x in linesList]
    pipesList = []
    pipesList1 = []
    TransactionManager.Instance.EnsureInTransaction(doc)
    for i,x in enumerate(firstPoint):
        try:
            levelId = sel_Level.Id
            sysTypeId = sel_pipingSystem.Id
            pipeTypeId = sel_PipeType.Id
            diam = diameter
            pipe = Autodesk.Revit.DB.Plumbing.Pipe.Create(doc,sysTypeId,pipeTypeId,levelId,x.ToXyz(),secondPoint[i].ToXyz())
            param_Diameter = pipe.get_Parameter(BuiltInParameter.RBS_PIPE_DIAMETER_PARAM)
            param_Diameter.SetValueString(diam.ToString())
            TransactionManager.Instance.EnsureInTransaction(doc)
            pipesList.append(pipe.ToDSType(False))
            pipesList1.append(pipe)
            # param_Length.Set()
            TransactionManager.Instance.TransactionTaskDone()
        except:
            pipesList.append(None)				
    TransactionManager.Instance.TransactionTaskDone()
    return pipesList
	
def getPipeParameter(p):
    paramDiameters = []
    paramPipingSystems = []
    paramLevels = []
    paramPipeTypes = []

    paramDiameter = p.get_Parameter(BuiltInParameter.RBS_PIPE_DIAMETER_PARAM).AsDouble() * 304.8
    
    paramPipeTypeId = p.GetTypeId()
    paramPipeType = doc.GetElement(paramPipeTypeId)
    paramPipeTypes.append(paramPipeType)
    pipeTypeName = paramPipeType.LookupParameter("Type Name").AsString()
	
    paramPipingSystemId = p.get_Parameter(BuiltInParameter.RBS_PIPING_SYSTEM_TYPE_PARAM).AsElementId()
    paramPipingSystem = doc.GetElement(paramPipingSystemId)
    paramPipingSystems.append(paramPipingSystem)
    pipingSystemName = paramPipingSystem.LookupParameter("System Classification").AsValueString()

    paramLevelId = p.get_Parameter(BuiltInParameter.RBS_START_LEVEL_PARAM).AsElementId()
    paramLevel = doc.GetElement(paramLevelId)
    paramLevels.append(paramLevel)

    return [paramDiameter, paramPipingSystem, paramPipeType, paramLevel],[paramDiameter,pipingSystemName,pipeTypeName,paramLevel]
    
def flatten(nestedList):
    flatList = []
    for item in nestedList:
        if isinstance(item, list):
            flatList.extend(flatten(item))
        else:
            flatList.append(item)
    return flatList
#endregion


pointList   = uwList(IN[0])
basePipe  = UnwrapElement(IN[1])

# Do some action in a Transaction
TransactionManager.Instance.EnsureInTransaction(doc)
basePipeParam = getPipeParameter(basePipe)
diamParam = basePipeParam[0][0]
pipingSystemParam = basePipeParam[0][1]
pipeTypeParam = basePipeParam[0][2]
levelParam = basePipeParam[0][3]
tempPipe = pipeCreateFromPoints(pointList, pipingSystemParam, pipeTypeParam, levelParam, diamParam)
TransactionManager.Instance.TransactionTaskDone()

OUT = flatten(tempPipe)
# ----------------------------------------

# group: connect temp Pipe to branch Pipe by elbow
list_create_2 = List.Create(item0=tmpPipe, item1=code_block_3.out4)
code_block_4 = CodeBlock(x=list_create_2) { List.Flatten(x); }
connect_tmpPipeAndBranchPipeByElbow = Python(IN[0]=code_block_4)  # IronPython2
# ---------- connect_tmpPipeAndBranchPipeByElbow.python (102 lines) ----------
"""Copyright by: vudinhduybm@gmail.com"""
#region ___import all Library
import clr
import sys 
import System   
import math
import collections

from math import *

clr.AddReference("ProtoGeometry")
from Autodesk.DesignScript.Geometry import *

clr.AddReference("RevitAPI") 
import Autodesk
from Autodesk.Revit.DB import* 
from Autodesk.Revit.DB.Structure import*

clr.AddReference("RevitAPIUI") 
from Autodesk.Revit.UI import*
from Autodesk.Revit.UI.Selection import ISelectionFilter

clr.AddReference("System") 
from System.Collections.Generic import List

clr.AddReference("RevitNodes")
import Revit
clr.ImportExtensions(Revit.Elements)
clr.ImportExtensions(Revit.GeometryConversion)

clr.AddReference("RevitServices")
import RevitServices
from RevitServices.Persistence import DocumentManager
from RevitServices.Transactions import TransactionManager

clr.AddReference("System.Windows.Forms")
clr.AddReference("System.Drawing")
clr.AddReference("System.Windows.Forms.DataVisualization")

import System.Windows.Forms 
from System.Windows.Forms import *
import System.Drawing
from System.Drawing import *
#endregion

#region ___Current doc/app/ui
doc = DocumentManager.Instance.CurrentDBDocument
uiapp = DocumentManager.Instance.CurrentUIApplication
app = uiapp.Application
uidoc = DocumentManager.Instance.CurrentUIApplication.ActiveUIDocument
view = doc.ActiveView
#endregion

#region ___someFunctions
def uwList(input):
    result = input if isinstance(input, list) else [input]
    return UnwrapElement(input)
def createElbow(doc, pipes):
	connectors = []
	elbowList = []
	try:
		for pipe in pipes:
			connectors.append(pipe.ConnectorManager.Connectors)
	except:
		pass

	TransactionManager.Instance.EnsureInTransaction(doc)
	
	try:
		for set1, set2 in zip(connectors[:-1], connectors[1:]):
			conStart = list(set1)
			conEnd = list(set2)
			d1 = conStart[0].Origin.DistanceTo(conEnd[0].Origin)*conStart[0].Origin.DistanceTo(conEnd[1].Origin)
			d2 = conStart[1].Origin.DistanceTo(conEnd[0].Origin)*conStart[1].Origin.DistanceTo(conEnd[1].Origin)
			i = 0
			if d1 > d2:
				i = 1
	
			d3 = conEnd[0].Origin.DistanceTo(conStart[0].Origin)*conEnd[0].Origin.DistanceTo(conStart[1].Origin)
			d4 = conEnd[1].Origin.DistanceTo(conStart[0].Origin)*conEnd[1].Origin.DistanceTo(conStart[1].Origin)
			j = 0
			if d3 > d4:
				j = 1
	
			fitting = doc.Create.NewElbowFitting(conStart[i],conEnd[j])
			elbowList.append(fitting)
	except:
		pass

	return elbowList
#endregion


pipeList   = uwList(IN[0])

# Do some action in a Transaction
TransactionManager.Instance.EnsureInTransaction(doc)
elbow = createElbow(doc, pipeList)

TransactionManager.Instance.TransactionTaskDone()

OUT = elbow
# ----------------------------------------
